# Grasshopper definition cpPaper.gh (Grasshopper 0.9.76)
# plug-ins: Python Interpreter, VirtualWindTunnel

toggle = BooleanToggle(False)
toggle_2 = BooleanToggle(False)
toggle_3 = BooleanToggle(False)
button = Button()
knob = ControlKnob(Decimals=0, Limit=True, Maximum=359, Minimum=0, Range=360, Value=90)
geo = Geometry([<brep referenced from the Rhino model> x10])
int = Integer(knob)
xz = XZPlane(Origin=Point(-0.0485980799, -4.042677826, 0))
c_script = CSharpScript(p=xz)  # -> out, B, A; inputs b: list of Brep, p: Plane
# ---------- c_script: C# ----------
    double pj = 0;
    A = FindFacades(p, b, out pj);
    B = pj;
# ---------- c_script: C# additional code ----------
  static List<Brep> FindFacades(Plane plane, List<Brep> volumes, out double projectedAreaTotal)
  {
    List<Brep> Facades = new List<Brep>();

    List<double> projectedAreas = new List<double>();
    foreach (Brep b in volumes)
    {
      for (int i = 0; i < b.Faces.Count; i++)
      {
        Vector3d vSurf = b.Faces[i].NormalAt(0.5, 0.5);
        double dot = plane.ZAxis * vSurf;
        if (dot < 0.1) continue;


        Brep face = b.Faces[i].DuplicateFace(false);
        //Print(dot + "");
        Facades.Add(face);

        Vector3d cross = Vector3d.CrossProduct(plane.ZAxis, vSurf);
        double norm = cross.Length;
        double angle = Math.Atan2(norm, dot);

        //Print((angle * 180 / Math.PI) + "");

        double projectedArea = face.GetArea() * Math.Cos(angle);

        projectedAreas.Add(projectedArea);
        //Print(projectedArea + "");
      }
    }
    projectedAreaTotal = projectedAreas.Sum(x => x);

    return Facades;
  }
# ---------- end c_script ----------
python = PythonScript()  # -> out, a
# ---------- python: Python ----------
a = x.BuildingGeometry
# ---------- end python ----------
panel = Panel(c_script.B)
cellsize = CellSize(Size="20.0", DesiredCellSize="1")
number_slider = Slider(5, range=0..10)
int_2 = Integer(number_slider)
number_slider_2 = Slider(4, range=0..10)
int_3 = Integer(number_slider_2)
number_slider_3 = Slider(2, range=0..10)
int_4 = Integer(number_slider_3)
number_slider_4 = Slider(4, range=0..10)
int_5 = Integer(number_slider_4)
concat = Concatenate(
    FragmentA="C:\cpPaper\cpPaper",
    FragmentB=int_3,
    FragmentC=int_2,
    FragmentD=int_4,
    FragmentE=int_5,
    FragmentF="_",
    FragmentG=int,
    FragmentH="\")
domaincyl = DomainCyl(
    Geometry=geo,
    Directory=concat,
    WindDir=knob,
    DivisionsOuterCirc=Slider(3, range=0..10),
    DivisionsZ=Slider(9, range=0..10),
    ScaleInnerR=Slider(0.5, range=0..1),
    RAM=Slider(1, range=0..64000),
    CPUs=Slider(6, range=1..8),
    Run=toggle)  # -> Out, Domain, Cyl
clean = Clean(Dir=concat, Run=Button())
panel_2 = Panel(concat)
cluster = Cluster()
panel_3 = Panel(cellsize)
python_2 = PythonScript()  # -> out, a, b, c, d, e, f
# ---------- python_2: Python ----------
a=x.BBox
b=x.centerGroundBBox
c=x.BBox.Min
d=x.BBox.Max
e=x.dimY
f=x.newBoxDomain.GetCorners
# ---------- end python_2 ----------
panel_4 = Panel(python_2.b)
panel_5 = Panel(python_2.f)
panel_6 = Panel(python_2.a)
panel_7 = Panel(python_2.c)
mesh = Mesh(
    Domain=domaincyl.Domain,
    AccBuilding=number_slider_2,
    AccFeatures=number_slider,
    AccGround=number_slider_3,
    Layer=number_slider_4,
    Run=toggle)  # -> Out, Domain
panel_8 = Panel("C:\MeshingPaper\withoutLayers\City_case_Cyl-wL-4710\")
panel_9 = Panel("C:\MeshingPaper\withoutLayers\City_case_WT-wL-4710_rF\")
panel_10 = Panel("C:\MeshingPaper\Ref_case_WT-5513_plots2\")
panel_11 = Panel("C:\MeshingPaper\A_high-rise_building_in_city_blocks_Cyl_plots\")
panel_12 = Panel("C:\MeshingPaper\Ref_case_Cyl-5513_plots\")
panel_13 = Panel("C:\MeshingPaper\A_high-rise_building_in_city_blocks_WT_plots2\")
button_2 = Button()
path = FilePath("C:\MeshingPaper\withoutLayers\City_case_WT-wL-4710\")
simulation = Simulation(
    Domain=mesh.Domain,
    Iterations=Slider(10, range=0..1000),
    WriteInterval=Slider(10, range=0..100),
    KeepTimeSteps=Slider(5, range=0..10),
    Mode=0,
    Run=Button())
residualwriter = ResidualWriter(FileP=path)
gradient = Gradient(
    LowerLimit=0,
    UpperLimit=1,
    stops=[0: RGB(234, 38, 0), 0.463: RGB(254, 244, 84), 0.75: RGB(173, 203, 249), 1: RGB(75, 107, 169)])  # disabled

# ----
# Plotter
toggle_4 = BooleanToggle(False)
c_script_2 = CSharpScript(Dir=path, Run=toggle_4)  # -> out, A; inputs Dir: String, Run: Boolean
# ---------- c_script_2: C# ----------
    System.Diagnostics.ProcessStartInfo psi = new System.Diagnostics.ProcessStartInfo();
    psi.WorkingDirectory = System.IO.Path.GetDirectoryName(Dir);
    psi.FileName = "gnuplot";
    psi.Arguments = "plotter.gnu";

    string csvName = "residuals.csv";


    string gnuCommands = @"set key autotitle columnhead
      set logscale y
      set ylabel 'Residual'
      set xlabel 'Iteration'
      set format y ""10^{%T}""
      set datafile separator ','
      plot """ + csvName + @""" u($0):2 with lines, """ + csvName + @""" u($0):3 with lines, """ + csvName + @""" u($0):4 with lines, """ + csvName + @""" u($0):5 with lines, """ + csvName + @""" u($0):6 with lines, """ + csvName + @""" u($0):7 with lines
      set terminal pdf
      set output ""residuals.pdf""
      replot
      #pause 5
      #reread
      ";


    System.IO.File.WriteAllText(psi.WorkingDirectory + @"\plotter.gnu", gnuCommands);


    System.Diagnostics.Process p = new System.Diagnostics.Process();
    p.StartInfo = psi;

    if(Run == true){  p.Start();
      p.WaitForExit();
    }
# ---------- end c_script_2 ----------

vdisex = VectorDisplayEx(Colour=gradient, Width=2)  # disabled
c_script_3 = CSharpScript(Dir=path, Run=toggle_4)  # -> out, A; inputs Dir: String, Run: Boolean
# ---------- c_script_3: C# ----------
    System.Diagnostics.ProcessStartInfo psi = new System.Diagnostics.ProcessStartInfo();
    psi.WorkingDirectory = System.IO.Path.GetDirectoryName(Dir);
    psi.FileName = "gnuplot";
    psi.Arguments = "plotter.gnu";

    string csvName = "residuals.csv";


    string gnuCommands = @"set key autotitle columnhead
      set logscale y
      set ylabel 'Residual'
      set xlabel 'Iteration'
      set format y ""10^{%T}""
      set grid ytics lc rgb ""#bbbbbb"" lw 1 lt 0
      set grid xtics lc rgb ""#bbbbbb"" lw 1 lt 0
      set datafile separator ','
      plot """ + csvName + @""" u($0):2 with lines, """ + csvName + @""" u($0):3 with lines, """ + csvName + @""" u($0):4 with lines, """ + csvName + @""" u($0):5 with lines, """ + csvName + @""" u($0):6 with lines, """ + csvName + @""" u($0):7 with lines
      pause 5
      reread
      ";


    System.IO.File.WriteAllText(psi.WorkingDirectory + @"\plotter.gnu", gnuCommands);


    System.Diagnostics.Process p = new System.Diagnostics.Process();
    p.StartInfo = psi;

    if(Run == true){  p.Start();
      p.WaitForExit();
    }
# ---------- end c_script_3 ----------

# ==== cluster Cluster
number_slider = Slider(0, range=0..17)
bacc = Panel("""3
4
5
6
7
8
3
4
5
6
7
8
3
4
5
6
7
8""")
panel = Panel("""3
4
5
6
7
8
3
4
5
6
7
8
3
4
5
6
7
8""")
item = ListItem(List=bacc, Index=number_slider, Wrap=True)
item_2 = ListItem(List=panel, Index=number_slider, Wrap=True)
panel_2 = Panel("""3
3
3
3
3
3
4
4
4
4
4
4
5
5
5
5
5
5""")
item_3 = ListItem(List=panel_2, Index=number_slider, Wrap=True)
