# Grasshopper definition residuals_meshing_paper.gh (Grasshopper 0.9.76)
# plug-ins: VirtualWindTunnel

residualwriter = ResidualWriter(WorkingDir="C:\MeshingPaper\take2\done\cyl\very_coarse\", Mode=1)
residualwriter_2 = ResidualWriter(WorkingDir="C:\MeshingPaper\take2\done\cyl\coarse\", Mode=1)
residualwriter_3 = ResidualWriter(WorkingDir="C:\MeshingPaper\take2\done\box\coarse\", Mode=1)
residualwriter_4 = ResidualWriter(WorkingDir="C:\MeshingPaper\take2\done\box\very_coarse\", Mode=1)
residualwriter_5 = ResidualWriter(Mode=0)
residualwriter_6 = ResidualWriter(Mode=0)
