# Grasshopper definition 10_IndoorExample.ghx (Grasshopper 1.0.7)
# plug-ins: Eddy3D

geo = Geometry(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)
geo_2 = Geometry(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)
geo_3 = Geometry(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)
facen = FaceNormals(Mesh=geo_2)  # -> Centers, Normals
c_script = CSharpScript(Reference="C:\Users\pkastner\Downloads\Newtonsoft.Json.dll")  # -> out, A
# ---------- c_script: C# usings ----------
using Newtonsoft.Json;
# ---------- c_script: C# ----------
    var a = GetFixedValue();
    A = JsonConvert.SerializeObject(a);
# ---------- c_script: C# additional code ----------
  
  private static Dictionary<string, Dictionary<string, string>> GetFixedValue()
  {
    Dictionary<string, Dictionary<string, string>> Dict = new Dictionary<string, Dictionary<string, string>>();

    Dictionary<string, string> InternalDict = new Dictionary<string, string>();

    Dict.Add("test", InternalDict);



      InternalDict.Add("type", "fixedValue");
      InternalDict.Add("value", "uniform (" + new Vector3d(1,2,3).ToString().Trim(',') + ")");
     

    return Dict;
  }
# ---------- end c_script ----------
geo_4 = Geometry(Geo=geo, Temp=Slider(20, range=0..100))
ol = Outlet(Geo=geo_3, Vel=Vector(0, 0, 0))
il = Inlet(Geo=geo_2, Vel=facen.Normals, Temp=Slider(20, range=0..100))
panel = Panel(c_script.A)
idom = IndoorDomain(Geo=geo_4, Inlet=il, Outlet=ol, Directory="C:\Temp\EddyProject", CellSize=1)
