# Grasshopper definition 3_SimpleWindAnalysis.gh (Grasshopper 1.0.7)
# plug-ins: VirtualWindTunnel

panel = Panel("C:\DIVA\WeatherData\USA_IL_Chicago-OHare.Intl.AP.725300_TMY3.epw")
# Box
panel_2 = Panel("0")
abl = ABL(WDir=panel_2, Uref=5, Zref=10, Z0=1, ZGround=0, Epw=panel)
geo = Geometry([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])
domainbox = BoxShapedDomain(Geometry=geo, BCond=abl, BlockSize=Slider(10, range=0..10))  # -> Domain, Mesh
mset = MeshSettings(AccBuilding=2, AccFeatures="3", AccRefinement=0, AccGround=2, NLayer="2", Mode=2)
rset = RunSettings(
    Iterations="400",
    WriteInterval=20,
    KeepTimeSteps=2,
    Turbulence=1,
    RelaxationFactors=0,
    Mode=0,
    CPUs="2",
    OperationSystem=0)
simulation = Simulation(
    Domain=domainbox.Domain,
    Directory="C:\test",
    MeshSettings=mset,
    RunSettings=rset,
    RunMeshing=Button(),
    RunSimulation=Button(),
    runWithBlueCFD=True)
clean = Clean(Directory="C:\test", Mode=2, Run=Button())
paraview = Paraview(Res=simulation, Version=2, Run=Button())
residuals = Residuals(Res=simulation, X=":", Y=":", Version=0, Run=Button(), visResiduals=True)
visprobes = VisualizeProbes(Result=simulation, NameOfInstance="test", NameOfField=0, Run=Button(), Culling=True)  # -> PorbingPoints, ProbingResult
vectors = Data(visprobes.ProbingResult)
points = Data(visprobes.PorbingPoints)
dir = Slider(0, range=0..7)
choose_dir = TreeBranch(Tree=vectors, Path=dir, MaintainPaths=True)
cluster = Cluster(data=choose_dir)  # -> S, E, data_3
gradient = Gradient(
    LowerLimit=cluster.S,
    UpperLimit=Slider(6, range=0..10),
    Parameter=cluster.data_3,
    stops=[0.103: RGB(0, 0, 255), 0.22: RGB(0, 170, 255), 0.305: RGB(0, 255, 255), 0.398: RGB(0, 255, 188), 0.504: RGB(0, 255, 106), 0.605: RGB(91, 255, 0), 0.699: RGB(184, 255, 0), 0.799: RGB(255, 255, 0), 0.898: RGB(255, 170, 0)])
vdisex = VectorDisplayEx(Point=points, Vector=choose_dir, Colour=gradient, Width=Slider(3, range=0..10))

# ==== cluster Cluster
data = ClusterInput()
data_2 = Data(data)
data_3 = ClusterOutput(data_2)
bnd = Bounds(Numbers=data_2)
dedomain = DeconstructDomain(Domain=bnd)  # -> Start, End
S = ClusterOutput(dedomain.Start)
E = ClusterOutput(dedomain.End)
