# Grasshopper definition 3_SimpleWindAnalysis.ghx (Grasshopper 1.0.7)
# plug-ins: Eddy3D, MeshEdit Components

# ----
# 1. Geometry &
# Boundary Conditions
panel = Panel("0")
abl = ABL(WDir=panel, Uref=5, Zref=10, Z0=1, ZGround=0)

geo = Geometry(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)
cluster = Cluster_2()

# ----
# 2. Simulation Domain
domainbox = BoxShapedDomain(Geometry=cluster, Terrain=geo, BoundaryCondition=abl, BlockSize=20)  # -> Domain, Mesh

srf = Surface(<surface referenced from the Rhino model>)
tri = Triangulate(Mesh=srf)  # -> Mesh, Count
mesh = Mesh(tri.Mesh)
explode = MeshExplode(Mesh=mesh, Interpolate=False)
medges = MeshEdges(Mesh=mesh)  # -> NakedEdges, InteriorEdges, NonManifoldEdges
faceb = FaceBoundaries(Mesh=explode)
angle = Angle()  # -> Angle, Reflex
vec = VectorXYZ(XComponent=Slider(0, range=0..100), YComponent=Slider(0, range=0..100), ZComponent=Slider(-1, range=-1..1))  # -> Vector, Length
vec_2 = VectorXYZ(XComponent=Slider(0, range=0..100), YComponent=Slider(0, range=0..100), ZComponent=Slider(1, range=-1..1))  # -> Vector, Length
disc = Discontinuity(Curve=faceb, Level=1)  # -> Points, Parameters
custom_mesh_settings = SettingsCustom(
    StitchSeams=True,
    SimplePlanes=False,
    Refine=True,
    MinCount=16,
    MaxCount=400,
    AspectRatio=20,
    MaxDistance=0,
    MaxAngle=20,
    MinEdge=0,
    MaxEdge="1")
lng = ListLength(List=disc.Points)
equals = Equality(FirstNumber=lng, SecondNumber="3")  # -> Equality, Inequality
brep = Brep(<brep referenced from the Rhino model>)
mesh_2 = MeshBrep(Brep=brep, Settings=custom_mesh_settings)
demesh = DeconstructMesh(Mesh=mesh_2)  # -> Vertices, Faces, Colours, Normals
c_script = CSharpScript(x=vec_2.Vector, y=vec.Vector)  # -> out, A; inputs x: Vector3d, y: Vector3d
# ---------- c_script: C# ----------
    string str_error2 = "";
    
    A = Angle_3D(x, y, out str_error2);
# ---------- c_script: C# additional code ----------
  public static double Angle_3D(Vector3d A, Vector3d B, out string str_error)
  {
    
    str_error = "";
    //IL_0038: Unknown result type (might be due to invalid IL or missing references)
    //IL_0039: Unknown result type (might be due to invalid IL or missing references)
    if (!((Vector3d)( A)).Unitize())
    {
      str_error = "First vector is zero-length";
      return double.NaN;
    }
    if (!((Vector3d)( B)).Unitize())
    {
      str_error = "Second vector is zero-length";
      return double.NaN;
    }
    return Math.Acos(Math.Max(Math.Min(A * B, 1.0), -1.0));
  }
# ---------- end c_script ----------
cull = CullPattern(List=lng, CullPattern=equals.Equality)
mesh_3 = Mesh(brep)
tri_2 = Triangulate(Mesh=mesh_3)  # -> Mesh, Count
demesh_2 = DeconstructMesh(Mesh=tri_2.Mesh)  # -> flatten(Vertices), Faces, Colours, Normals
E = CleanEmpty(True)
cos = Cosine(Value=c_script.A)
quad = Quadrangulate(Mesh=mesh_3, Angle=0.03490658504, Ratio=0.875)  # -> Mesh, Count
clean = CleanTree(Data=cull, CleanInvalid=True, CleanEmpty=E)
panel_2 = Panel(cos)
tstat = TreeStatistics(Tree=clean)  # -> Paths, Length, Count
lng_2 = ListLength(List=tstat.Paths)
panel_3 = Panel(lng_2)

# ----
# 3. Mesh & Simulation
panel_4 = Panel("3")
panel_5 = Panel("C:\3_SimpleWindAnalysis")
panel_6 = Panel("100")
button = Button()
rset = RunSettings(
    NumberOfIterations=1000,
    WriteInterval=20,
    NumberOfTimestepsToKeep=3,
    TurbulenceModel=1,
    RelaxationFactors=3,
    SolutionAndAlgorithmControl=1,
    PotentialFoamInitialization=False,
    AgeOfAir=False,
    NumberOfCPUs="-1",
    OperatingSystem=0)

mset = MeshSettings(AccBuilding=2, AccFeatures=panel_4, AccBBox=0, AccGround=panel_4, MiscSettings=1, NumberOfLayers=4, Mode=2)

simulation = Simulation(
    SimulationDomain=domainbox.Domain,
    WorkingDirectory=panel_5,
    MeshSettings=mset,
    RunSettings=rset,
    RunMeshing=button,
    MakeTrees=False,
    RunSimulation=button,
    runWithBlueCFD=True)
residuals = Residuals(Result=simulation, X=":", Y=":", Version=1, Run=Button(), visResiduals=True)

# ----
# 4. Probing points & probing
number_slider = Slider(5, range=1..30)
brep_2 = Brep(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)
brep_3 = Brep(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)
meshplane = MeshPlane(brep=brep, number=number_slider)
visprobes = VisualizeProbes(Result=simulation, ProbingPoints=demesh_2.Vertices, NameOfInstance="ttt", NameOfField=0, Run=Button())  # -> PorbingPoints, ProbingResult
probing = Probing(BuildingMesh=cluster, Points=meshplane)

c_script_2 = CSharpScript(m=tri_2.Mesh, U=visprobes.ProbingResult)  # -> out, flatten(Flow), Cent, Norm; inputs m: Mesh, U: list of Vector3d
# ---------- c_script_2: C# ----------
    var faces = m.Faces;
    var faceNormals = m.FaceNormals;

    var flows = new double[m.Faces.Count];
    var normals = new Vector3d[m.Faces.Count];
    var centers = new Point3d[m.Faces.Count];

    m.FaceNormals.ComputeFaceNormals();



    for (int mf_id = 0; mf_id < m.Faces.Count; mf_id++){

      //get points into a nice, concise format


      Point3d[] pts = new Point3d[4];
      pts[0] = m.Vertices[m.Faces[mf_id].A];
      pts[1] = m.Vertices[m.Faces[mf_id].B];
      pts[2] = m.Vertices[m.Faces[mf_id].C];
      if (m.Faces[mf_id].IsQuad)
      {
        pts[3] = m.Vertices[m.Faces[mf_id].D];
      }



      var avgVec = new Vector3d();
      var center = new Point3d();

      if (m.Faces[mf_id].IsQuad){


        avgVec = AverageVectors(new List<Vector3d> (){U[m.Faces[mf_id].A], U[m.Faces[mf_id].B], U[m.Faces[mf_id].C], U[m.Faces[mf_id].D]});
        center = AveragePoints(new List<Point3d >(){  pts[0], pts[1],    pts[2], pts[3]});
      }

      else{

        avgVec = AverageVectors(new List<Vector3d> (){U[m.Faces[mf_id].A], U[m.Faces[mf_id].B], U[m.Faces[mf_id].C]});
        center = AveragePoints(new List<Point3d >(){  pts[0], pts[1],    pts[2]});

      }
      string error = "";





      var angleBetween = Angle_3D(avgVec, m.FaceNormals[mf_id], out error);


      centers[mf_id] = center;
      normals[mf_id] = avgVec;
      flows[mf_id] = MeshFaceArea(mf_id, m) * Math.Cos(angleBetween);



    }




    Flow = flows;


    Cent = centers;
    Norm = normals;
# ---------- c_script_2: C# additional code ----------
  public static double Angle_3D(Vector3d A, Vector3d B, out string str_error)
  {

    str_error = "";
    //IL_0038: Unknown result type (might be due to invalid IL or missing references)
    //IL_0039: Unknown result type (might be due to invalid IL or missing references)
    if (!((Vector3d) ( A)).Unitize())
    {
      str_error = "First vector is zero-length";
      return double.NaN;
    }
    if (!((Vector3d) ( B)).Unitize())
    {
      str_error = "Second vector is zero-length";
      return double.NaN;
    }
    return Math.Acos(Math.Max(Math.Min(A * B, 1.0), -1.0));
  }

  public static double MeshFaceArea(int meshfaceindex, Mesh m)
  {
    //get points into a nice, concise format
    Point3d[] pts = new Point3d[4];
    pts[0] = m.Vertices[m.Faces[meshfaceindex].A];
    pts[1] = m.Vertices[m.Faces[meshfaceindex].B];
    pts[2] = m.Vertices[m.Faces[meshfaceindex].C];
    if (m.Faces[meshfaceindex].IsQuad)
    {
      pts[3] = m.Vertices[m.Faces[meshfaceindex].D];
    }

    //calculate areas of triangles
    double a = pts[0].DistanceTo(pts[1]);
    double b = pts[1].DistanceTo(pts[2]);
    double c = pts[2].DistanceTo(pts[0]);
    double p = 0.5 * (a + b + c);
    double area1 = Math.Sqrt(p * (p - a) * (p - b) * (p - c));

    //if quad, calc area of second triangle
    double area2 = 0;
    if (m.Faces[meshfaceindex].IsQuad)
    {
      a = pts[0].DistanceTo(pts[2]);
      b = pts[2].DistanceTo(pts[3]);
      c = pts[3].DistanceTo(pts[0]);
      p = 0.5 * (a + b + c);
      area2 = Math.Sqrt(p * (p - a) * (p - b) * (p - c));
    }

    return area1 + area2;
  }

  public static Vector3d AverageVectors (List<Vector3d> list){

    Vector3d val3 = Vector3d.Zero;
    int num9 = 0;
    int num10 = list.Count - 1;
    for (int m = 0; m <= num10; m++)
    {
      if (list[m] != null)
      {
        val3 += list[m];
        num9++;
      }
    }
    // if (num9 != 0)
    // {
    return (val3 / (double) num9);
    //}


  }

  public static Point3d AveragePoints (List<Point3d> list){

    Point3d val2 = Point3d.Origin;
    int num7 = 0;
    int num8 = list.Count - 1;
    for (int l = 0; l <= num8; l++)
    {
      if (list[l] != null)
      {
        val2 += list[l];
        num7++;
      }
    }
    //if (num7 != 0)
    // {
    return (val2 / (double) num7);
    //  }


  }
# ---------- end c_script_2 ----------
vdis = VectorDisplay(Anchor=c_script_2.Cent, Vector=c_script_2.Norm)
panel_7 = Panel(c_script_2.Flow)
flow_rates = FlowRates(VelocityVectors=visprobes.ProbingResult, Mesh=mesh_3)  # -> Result, Min, Max
avr = Average(Input=visprobes.PorbingPoints)
avr_2 = Average(Input=visprobes.ProbingResult)
vdis_2 = VectorDisplay(Anchor=avr, Vector=avr_2)

# ----
# 5. Post-processing
# 5.1. Paraview
# 5.2. Grasshopper
# Wind vectors
points = Data(visprobes.PorbingPoints)
vectors = Data(visprobes.ProbingResult)
cluster_2 = Cluster(data=vectors)  # -> S, E, data_3
gradient = Gradient(
    LowerLimit=cluster_2.S,
    UpperLimit=Slider(5, range=0..10),
    Parameter=cluster_2.data_3,
    stops=[0.103: RGB(0, 0, 255), 0.22: RGB(0, 170, 255), 0.305: RGB(0, 255, 255), 0.398: RGB(0, 255, 188), 0.504: RGB(0, 255, 106), 0.605: RGB(91, 255, 0), 0.699: RGB(184, 255, 0), 0.799: RGB(255, 255, 0), 0.898: RGB(255, 170, 0)])
vdisex = VectorDisplayEx(Point=points, Vector=vectors, Colour=gradient, Width=Slider(2, range=0..10))

# ----
# 6. Clean
button_2 = Button()
clean_2 = Clean(Directory=panel_5, Mode=2, Run=button_2)

ma = MassAddition(Input=panel_7)  # -> flatten(Result), PartialResults
paraview = Paraview(Result=simulation, ParaviewVersion=2, Run=Button())
panel_8 = Panel(ma.Result)

# ==== cluster MeshPlane
number = ClusterInput()
number_2 = Number(number)
settings_custom = SettingsCustom(
    StitchSeams=True,
    SimplePlanes=False,
    Refine=True,
    MinCount=16,
    MaxCount=400,
    AspectRatio=20,
    MaxDistance=0,
    MaxAngle=20,
    MinEdge=number_2,
    MaxEdge=number_2)
brep = ClusterInput()
mesh_brep = MeshBrep(Brep=brep, Settings=settings_custom)
deconstruct_mesh = DeconstructMesh(Mesh=mesh_brep)  # -> Vertices, Faces, Colours, Normals
vertices = ClusterOutput(deconstruct_mesh.Vertices)

# ==== cluster Cluster
data = ClusterInput()
data_2 = Data(data)
data_3 = ClusterOutput(data_2)
bnd = Bounds(Numbers=data_2)
dedomain = DeconstructDomain(Domain=bnd)  # -> Start, End
S = ClusterOutput(dedomain.Start)
E = ClusterOutput(dedomain.End)

# ==== cluster Cluster_2
geo = Geometry([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])
mesh = Mesh(geo)
mjoin = MeshJoin(Meshes=mesh)
M = ClusterOutput(mjoin)
