# Grasshopper definition 3_SimpleWindAnalysisWithTree.ghx (Grasshopper 1.0.7)
# plug-ins: Eddy3D

# ----
# 1. Geometry &
# Boundary Conditions
panel = Panel("0")
abl = ABL(WDir=panel, Uref=5, Zref=10, Z0=1, ZGround=0)

cluster = Cluster_2()
cluster_2 = Cluster_2()
cluster_3 = Cluster_3(G=cluster)
geo = Geometry(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)
geo_2 = Geometry(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)
geo_3 = Geometry([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])
tree = Tree(Geo=geo, Type="dense")
tree_2 = Tree(Geo=geo_2, Type="medium")
tree_3 = Tree(Geo=geo_3, Type="dense")
relay = Relay([cluster_2, cluster_3])

# ----
# 2. Simulation Domain
domainbox = BoxShapedDomain(Geometry=relay, Trees=[tree, tree_2, tree_3], BoundaryCondition=abl, BlockSize=20)  # -> Domain, Mesh

number_slider = Slider(1, range=0..10)
geo_4 = Geometry(<brep referenced from the Rhino model>)
geo_5 = Geometry(cluster_3)
geo_6 = Geometry([<brep referenced from the Rhino model> x2])
mjoin = MeshJoin(Meshes=geo_6)
number_slider_2 = Slider(1, range=0..1)
mesh = Mesh(geo_4)
toggle = BooleanToggle(True)
mmx = MeshMesh(MeshA=relay, MeshB=mesh, UseMeshMeshFast=True)  # -> flatten(Intersections)
mjoin_2 = MeshJoin(Meshes=relay)
explode = Explode(Curve=mmx, Recursive=True)  # -> flatten(Segments), Vertices
line = Line(explode.Segments)
boundary = BoundarySurfaces(Edges=line)
sdiff = SolidDifference(BrepsA=geo_4, BrepsB=boundary)
mesh_2 = Mesh(boundary)
msplit = MeshSplit(Splitters=mesh_2)
mint = MeshIntersection(MeshesB=mesh_2)
mdif = MeshDifference(MeshesB=mesh_2)

# ----
# 3. Mesh & Simulation
panel_2 = Panel("C:\3_SimpleWindAnalysisWithTree")
rset = RunSettings(
    NumberOfIterations="1500",
    WriteInterval=20,
    NumberOfTimestepsToKeep=3,
    TurbulenceModel=1,
    RelaxationFactors=3,
    SolutionAndAlgorithmControl=1,
    PotentialFoamInitialization=False,
    AgeOfAir=False,
    NumberOfCPUs="-1",
    OperatingSystem=0)

mset = MeshSettings(AccBuilding=2, AccFeatures="3", AccBBox="3", AccGround="3", MiscSettings=1, NumberOfLayers=4, Mode=2)

simulation = Simulation(
    SimulationDomain=domainbox.Domain,
    WorkingDirectory=panel_2,
    MeshSettings=mset,
    RunSettings=rset,
    RunMeshing=Button(),
    MakeTrees=Button(),
    RunSimulation=Button(),
    runWithBlueCFD=True)
residuals = Residuals(Result=simulation, X=":", Y=":", Version=1, Run=Button(), visResiduals=True)

# ----
# 4. Probing points & probing
number_slider_3 = Slider(2, range=1..30)
brep = Brep(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)
brep_2 = Brep(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)
meshplane = MeshPlane(brep=brep_2, number=number_slider_3)
probing = Probing(BuildingMesh=mjoin_2, Points=meshplane)
visprobes = VisualizeProbes(Result=simulation, ProbingPoints=probing, NameOfInstance="ttt", NameOfField=0, Run=Button())  # -> PorbingPoints, ProbingResult

del = DelaunayMesh(Points=probing, Plane=PlaneXY(0, 0, 0))
demesh = DeconstructMesh(Mesh=del)  # -> Vertices, Faces, Colours, Normals

# ----
# 5. Post-processing
# 5.1. Paraview
# 5.2. Grasshopper
# Wind vectors
points = Data(visprobes.PorbingPoints)
vectors = Data(visprobes.ProbingResult)
cluster_4 = Cluster(data=vectors)  # -> S, E, data_3
gradient = Gradient(
    LowerLimit=cluster_4.S,
    UpperLimit=Slider(5, range=0..10),
    Parameter=cluster_4.data_3,
    stops=[0.103: RGB(0, 0, 255), 0.22: RGB(0, 170, 255), 0.305: RGB(0, 255, 255), 0.398: RGB(0, 255, 188), 0.504: RGB(0, 255, 106), 0.605: RGB(91, 255, 0), 0.699: RGB(184, 255, 0), 0.799: RGB(255, 255, 0), 0.898: RGB(255, 170, 0)])
vdisex = VectorDisplayEx(Point=points, Vector=vectors, Colour=gradient, Width=Slider(2, range=0..10))

conmesh = ConstructMesh(Vertices=demesh.Vertices, Faces=demesh.Faces, Colours=gradient)

# ----
# 6. Clean
button = Button()
clean = Clean(Directory=panel_2, Mode=2, Run=button)

paraview = Paraview(Result=simulation, ParaviewVersion=2, Run=Button())

# ==== cluster MeshPlane
number = ClusterInput()
number_2 = Number(number)
settings_custom = SettingsCustom(
    StitchSeams=True,
    SimplePlanes=False,
    Refine=True,
    MinCount=16,
    MaxCount=400,
    AspectRatio=20,
    MaxDistance=0,
    MaxAngle=20,
    MinEdge=number_2,
    MaxEdge=number_2)
brep = ClusterInput()
mesh_brep = MeshBrep(Brep=brep, Settings=settings_custom)
deconstruct_mesh = DeconstructMesh(Mesh=mesh_brep)  # -> Vertices, Faces, Colours, Normals
vertices = ClusterOutput(deconstruct_mesh.Vertices)

# ==== cluster Cluster
data = ClusterInput()
data_2 = Data(data)
data_3 = ClusterOutput(data_2)
bnd = Bounds(Numbers=data_2)
dedomain = DeconstructDomain(Domain=bnd)  # -> Start, End
S = ClusterOutput(dedomain.Start)
E = ClusterOutput(dedomain.End)

# ==== cluster Cluster_2
geo = Geometry([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])
mesh = Mesh(geo)
mjoin = MeshJoin(Meshes=mesh)
M = ClusterOutput(mjoin)

# ==== cluster Cluster_3
X = UnitX(Factor="150")
G = ClusterInput()
move = Move(Geometry=G, Motion=X)  # -> Geometry, Transform
G_2 = ClusterOutput(move.Geometry)
