# Grasshopper definition 5_PressureOnBuildingFacade.gh (Grasshopper 1.0.7)
# plug-ins: VirtualWindTunnel

# Box
number_slider = Slider(2, range=0..100)
panel = Panel("C:\DIVA\WeatherData\USA_IL_Chicago-OHare.Intl.AP.725300_TMY3.epw")
panel_2 = Panel("0")
geo = Geometry([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])
number_slider_2 = Slider(10, range=0..10)
abl = ABL(WDir=number_slider, Uref=5, Zref=10, Z0=1, ZGround=0, Epw=panel)
domainbox = BoxShapedDomain(Geometry=geo, BoundaryCondition=abl, BlockSize=20)  # -> Domain, Mesh
mset = MeshSettings(AccBuilding=2, AccFeatures="3", AccRefinement=0, AccGround=2, NLayer="2", Mode=2)
rset = RunSettings(
    Iterations="100",
    WriteInterval=20,
    KeepTimeSteps=2,
    Turbulence=1,
    RelaxationFactors=0,
    Mode=0,
    CPUs="4",
    OperationSystem=0)
simulation = Simulation(
    SimulationDomain=domainbox.Domain,
    WorkingDirectory="C:\test",
    MeshSettings=mset,
    RunSettings=rset,
    RunMeshing=Button(),
    RunSimulation=Button(),
    runWithBlueCFD=True)
clean = Clean(Directory="C:\test", Mode=2, Run=Button())
paraview = Paraview(Res=simulation, Version=2, Run=Button())
residuals = Residuals(Res=simulation, X=":", Y=":", Version=0, Run=Button(), visResiduals=True)
# Decompose and scale up Mesh
cluster = Cluster_2(data=geo)  # -> V, F
visprobes = VisualizeProbes(Result=simulation, PorbingPoints=cluster.V, NameOfInstance="pressure3", NameOfField=2, Run=Button(), Culling=False)  # -> PorbingPoints, ProbingResult
cluster_2 = Cluster(data=visprobes.ProbingResult)  # -> S, E, data_3
gradient = Gradient(
    LowerLimit="-20",
    UpperLimit=cluster_2.E,
    Parameter=cluster_2.data_3,
    stops=[0.103: RGB(0, 0, 255), 0.22: RGB(0, 170, 255), 0.305: RGB(0, 255, 255), 0.398: RGB(0, 255, 188), 0.504: RGB(0, 255, 106), 0.605: RGB(91, 255, 0), 0.699: RGB(184, 255, 0), 0.799: RGB(255, 255, 0), 0.898: RGB(255, 170, 0)])
# Visualize
conmesh = ConstructMesh(Vertices=visprobes.PorbingPoints, Faces=cluster.F, Colours=gradient)

# ==== cluster Cluster
data = ClusterInput()
data_2 = Data(data)
data_3 = ClusterOutput(data_2)
bnd = Bounds(Numbers=data_2)
dedomain = DeconstructDomain(Domain=bnd)  # -> Start, End
S = ClusterOutput(dedomain.Start)
E = ClusterOutput(dedomain.End)

# ==== cluster Cluster_2
data = ClusterInput()
number_slider = Slider(3, range=0..10)
data_2 = Data(data)
area = Area(Geometry=data_2)  # -> Area, Centroid
scale = Scale(Geometry=data_2, Center=area.Centroid, Factor=Slider(1.1, range=0..10))  # -> Geometry, Transform
custom_mesh_settings = SettingsCustom(
    StitchSeams=True,
    SimplePlanes=False,
    Refine=True,
    MinCount=16,
    MaxCount=400,
    AspectRatio=20,
    MaxDistance=0,
    MaxAngle=20,
    MinEdge=number_slider,
    MaxEdge=number_slider)
mesh = MeshBrep(Brep=scale.Geometry, Settings=custom_mesh_settings)
mjoin = MeshJoin(Meshes=mesh)
demesh = DeconstructMesh(Mesh=mjoin)  # -> Vertices, Faces, Colours, Normals
V = ClusterOutput(demesh.Vertices)
F = ClusterOutput(demesh.Faces)
