# Grasshopper definition 5_PressureOnBuildingFacade.ghx (Grasshopper 1.0.7)
# plug-ins: Eddy3D

panel = Panel("https://energyplus.net/weather-download/north_and_central_america_wmo_region_4/USA/NY/USA_NY_New.York-J.F.Kennedy.Intl.AP.744860_TMY3/USA_NY_New.York-J.F.Kennedy.Intl.AP.744860_TMY3.epw")
geo = Geometry([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])

# ----
# 2. Simulation Domain
number_slider = Slider(50, range=0..1000)
number_slider_2 = Slider(300, range=0..1000)
number_slider_3 = Slider(80, range=0..1000)
panel_2 = Panel("10")

# ----
# 4.1. Decompose and scale up Mesh
cluster = Cluster_2(data=geo)  # -> V, F

# ----
# 1. Geometry &
# Boundary Conditions
panel_3 = Panel("""0
45
90
135
180
225
270
315""")

# ----
# 3. Mesh & Simulation
panel_4 = Panel("1500")
panel_5 = Panel("C:\5_PressureOnBuildingFacade")

downloadepw = CSharpScript(epwURL=panel, folder=panel_5, download=Button())  # -> path; inputs epwURL: String, folder: String, download: Boolean
# ---------- downloadepw: C# usings ----------
using System.Net;
using System.IO;
# ---------- downloadepw: C# ----------
    
    if(!Directory.Exists(folder)){  Directory.CreateDirectory(folder);}


    if (download == true){

      DownLoadFile(epwURL, folder + "\\weather.epw");



    }

    path = folder + "\\weather.epw";
# ---------- downloadepw: C# additional code ----------
  public static void DownLoadFile(string URL, string FilePath)
  {
    WebClient webClient = new WebClient();
    webClient.DownloadFile(URL, FilePath);
  }
# ---------- end downloadepw ----------

abl = ABL(WDir=panel_3, Uref="10", Zref=10, Z0=1, ZGround=0, Epw=downloadepw)

domaincyl = CylindricalDomain(Geometry=geo, BoundaryCondition=abl, BlockSize=20)  # -> Domain, Mesh
mset = MeshSettings(AccBuilding=2, AccFeatures="3", AccBBox=0, AccGround="3", MiscSettings=1, NumberOfLayers=4, Mode=2)
rset = RunSettings(
    NumberOfIterations=panel_4,
    WriteInterval="1",
    NumberOfTimestepsToKeep=3,
    TurbulenceModel=1,
    RelaxationFactors=3,
    SolutionAndAlgorithmControl=1,
    PotentialFoamInitialization=False,
    AgeOfAir=False,
    NumberOfCPUs="6",
    OperatingSystem=0)
simulation = Simulation(
    SimulationDomain=domaincyl.Domain,
    WorkingDirectory=panel_5,
    MeshSettings=mset,
    RunSettings=rset,
    RunMeshing=Button(),
    MakeTrees=False,
    RunSimulation=Button(),
    runWithBlueCFD=True)

residuals = Residuals(Result=simulation, SelectionOfWindDirections=panel_3, X=":", Y=":", Version=1, Run=Button(), visResiduals=True)

# ----
# 4.2. Probing points & probing
panel_6 = Panel("pressure100")
visprobes = VisualizeProbes(Result=simulation, ProbingPoints=cluster.V, NameOfInstance=panel_6, NameOfField=1, Run=Button())  # -> PorbingPoints, ProbingResult

# ----
# 5. Post-processing
# 5.1. Change wind direction
number_slider_4 = Slider(2, range=0..10)
branch = TreeBranch(Tree=visprobes.ProbingResult, Path=number_slider_4, MaintainPaths=True)
cluster_2 = Cluster(data=branch)  # -> S, E, data_3
gradient = Gradient(
    LowerLimit="-1",
    UpperLimit="1",
    Parameter=cluster_2.data_3,
    stops=[0.103: RGB(0, 0, 255), 0.22: RGB(0, 170, 255), 0.305: RGB(0, 255, 255), 0.398: RGB(0, 255, 188), 0.504: RGB(0, 255, 106), 0.605: RGB(91, 255, 0), 0.699: RGB(184, 255, 0), 0.799: RGB(255, 255, 0), 0.898: RGB(255, 170, 0)])
conmesh = ConstructMesh(Vertices=cluster.V, Faces=cluster.F, Colours=gradient)

# ----
# 6. Clean
button = Button()
clean = Clean(Directory=simulation, Mode=2, Run=button)

# ==== cluster Cluster
data = ClusterInput()
data_2 = Data(data)
data_3 = ClusterOutput(data_2)
bnd = Bounds(Numbers=data_2)
dedomain = DeconstructDomain(Domain=bnd)  # -> Start, End
S = ClusterOutput(dedomain.Start)
E = ClusterOutput(dedomain.End)

# ==== cluster Cluster_2
data = ClusterInput()
data_2 = Data(data)
mesh = Mesh(data_2)
mjoin = MeshJoin(Meshes=mesh)
debrep = DeconstructBrep(Brep=data_2)  # -> flatten(Faces), Edges, Vertices
number_slider = Slider(2, range=0..10)
area = Area(Geometry=debrep.Faces)  # -> Area, Centroid
evalsrf = EvaluateSurface(Surface=debrep.Faces, Point=area.Centroid)  # -> Point, Normal, UDirection, VDirection, Frame
move = Move(Geometry=debrep.Faces, Motion=expr("x*0.1", evalsrf.Normal))  # -> Geometry, Transform
custom_mesh_settings = SettingsCustom(
    StitchSeams=True,
    SimplePlanes=False,
    Refine=True,
    MinCount=16,
    MaxCount=400,
    AspectRatio=20,
    MaxDistance=0,
    MaxAngle=20,
    MinEdge=number_slider,
    MaxEdge=number_slider)
Z = UnitZ(Factor=1)
dprod = DotProduct(VectorA=evalsrf.Normal, VectorB=Z, Unitize=False)
scale = Scale(Geometry=move.Geometry, Center=area.Centroid, Factor=Slider(0.99, range=0..1))  # -> Geometry, Transform
larger = LargerThan(FirstNumber=dprod, SecondNumber="0")  # -> LargerThan, OrEqualTo
dispatch = Dispatch(List=scale.Geometry, DispatchPattern=larger.OrEqualTo)  # -> ListA, ListB
mesh_2 = MeshBrep(Brep=dispatch.ListA, Settings=custom_mesh_settings)
mjoin_2 = MeshJoin(Meshes=mesh_2)
demesh = DeconstructMesh(Mesh=mjoin_2)  # -> Vertices, Faces, Colours, Normals
probing = Probing(BuildingMesh=mjoin, Points=demesh.Vertices, ConvertQuadsToTriangles=False)  # disabled
F = ClusterOutput(demesh.Faces)
V = ClusterOutput(demesh.Vertices)
