# Grasshopper definition 7_IndoorCase.ghx (Grasshopper 1.0.8)
# plug-ins: Eddy3D

brep = Brep(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)
vec = VectorXYZ(XComponent=0, YComponent="1", ZComponent=0)  # -> Vector, Length
bbox = BoundingBox(Content=brep, Plane=PlaneXY(0, 0, 0))  # -> Box, Box_2

# ---- group: Probing Plane
srf = Surface(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)
mesh_uv = MeshSurface(Surface=srf, UCount="30", VCount="30", Overhang=True, Equalize=False)

# ----
srf_2 = Surface(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)
srf_3 = Surface(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)
ol = Outlet(Geo=srf_2, Vel=Vector(0, 0, 0))
geo = Geometry(Geo=brep, Temp="20")
il = Inlet(Geo=srf_3, Vel=vec.Vector, Temp="20")
volume = Volume(Geometry=bbox.Box_2)  # -> Volume, Centroid
facen = FaceNormals(Mesh=mesh_uv)  # -> Centers, Normals
idom = IndoorDomain(
    Geo=geo,
    Inlet=il,
    Outlet=ol,
    Directory="C:\Eddy3D-Cases\IndoorCase\0\",
    PointInside=volume.Centroid,
    CellSize=".5",
    Iterations="2000",
    Run=Button())  # -> Domain, Result
probing = Probing(
    Result=idom.Result,
    ProbingPoints=facen.Centers,
    NameOfInstance="probing",
    InterpolationScheme=1,
    NameOfField=0,
    Run=Button())  # -> ProbingPoints, ProbingResult
vlen = VectorLength(Vector=probing.ProbingResult)
gradient = Gradient(
    LowerLimit="0",
    UpperLimit="2",
    Parameter=vlen,
    stops=[0: RGB(234, 38, 0), 0.25: RGB(234, 126, 0), 0.5: RGB(254, 244, 84), 0.75: RGB(173, 203, 249), 1: RGB(75, 107, 169)])
vdisex = VectorDisplayEx(Point=probing.ProbingPoints, Vector=probing.ProbingResult, Colour=gradient, Width=2)
