# Grasshopper definition 99_Restaurant_EDDY_COVIDgh_Validation.ghx (Grasshopper 1.0.7)
# plug-ins: Heteroptera, MeshEdit Components, Eddy3D, HAL for Grasshopper

# EDDY COVID-19:
# 
# Restaurant Validation Experiment:
# 
# Reference:
# https://www.medrxiv.org/content/10.1101/2020.04.16.20067728v1.full.pdf
# https://www.ncbi.nlm.nih.gov/pmc/articles/PMC7323555/
# 
# Ventilation Rates used:
# - high ventilation
# flow rate = 212  ft^2/min  (1.08m/s)
# - low ventilation
# flow rate = 15  ft^2/min (0.08m/s)
# 
# Emitter:
#  -located at  (1 m, 0.5 m,
# 1.6 m)
# - injection direction of (0, 1, 0)
# - average emission flow 0.21m/s
# - size tracer gas pipe= 8-mm inner diameter
# - speed =1.5 m/s
# 
# -temperature =32–34 °C
# 
# -Five coil AC unit: from Daiking website:
# https://www.daikinkuwait.com/content/dam/document-library/
# catalogues/as/fan-coil-units/fwd-at/FWV_FWL_FWM_FWD_
# FWB_EPCE04-25B_Catalogues_English.pdf
# 
# Measured Air flow:
# non-ABC zone = 1.04 L/s per patron
# ABC zone =  0.75 L/s per patron
sessionsettings = SessionSettings()

# ----
# Point locations to measure concentration
# Values from the Restaurant Paper
normalized_measured_concentration = Panel("""1
0.87
0.98
0
0
0
0
0
0
0.55
0
0
0
0
0.58
0.7
0.86
0.73""")
normalized_predicted_concentration = Panel("""1
1.04
0.93
1
0.62
0.47
0.42
0.42
0.32
0.52
0.57
0.5
0.55
0.63
0.54
0.56
0.5
0.85""")
_04 = Point(<point referenced from the Rhino model>)
_06 = Point(<point referenced from the Rhino model>)
_09 = Point(<point referenced from the Rhino model>)
_10 = Point(<point referenced from the Rhino model>)
_13 = Point(<point referenced from the Rhino model>)
_17 = Point(<point referenced from the Rhino model>)
_18 = Point(<point referenced from the Rhino model>)
_05 = Point(<point referenced from the Rhino model>)
_07 = Point(<point referenced from the Rhino model>)
_08 = Point(<point referenced from the Rhino model>)
_11 = Point(<point referenced from the Rhino model>)
_12 = Point(<point referenced from the Rhino model>)
_14 = Point(<point referenced from the Rhino model>)
_16 = Point(<point referenced from the Rhino model>)
pta = Point(<point referenced from the Rhino model>)
ptb = Point(<point referenced from the Rhino model>)
ptc = Point(<point referenced from the Rhino model>)
_15 = Point(<point referenced from the Rhino model>)
pt = Point([pta, ptb, ptc, _04, _05, _06, _07, _08, _09, _10, _11, _12, _13, _14, _15, _16, _17, _18])

# ----
# Validation Case
volume = Brep([<brep referenced from the Rhino model> x32])
brep_join = BrepJoin(Breps=volume)  # -> Breps, Closed

ventilation_inlet_fire_stair_door = Brep(<brep referenced from the Rhino model>)
ventilation_inlet_bathroom = Brep(<brep referenced from the Rhino model>)

infected_emitter_mesh = Brep(<brep referenced from the Rhino model>)
center = Center(Geometry=infected_emitter_mesh)  # -> Center, Dimension
face_normals = FaceNormals(Mesh=infected_emitter_mesh)  # -> Centers, Normals
tracer_gas_emission_speed = Panel("-1.5")
multiplication = Multiplication(A=face_normals.Normals, B=tracer_gas_emission_speed)
vector_display_ex = VectorDisplayEx(Point=center.Center, Vector=multiplication, Colour=RGB(255, 0, 0), Width=2)

ventilation_outlet = Brep(<brep referenced from the Rhino model>)
face_normals_2 = FaceNormals(Mesh=ventilation_outlet)  # -> Centers, Normals
vector_display_ex_2 = VectorDisplayEx(Point=face_normals_2.Centers, Vector=face_normals_2.Normals, Colour=RGB(255, 0, 0), Width=2)

tables = Brep([<brep referenced from the Rhino model> x18])

panel = Panel("230")
panel_2 = Panel("320")
panel_3 = Panel("400")
m_3_h = Panel("170")

convert_1_h_1_s = Panel("3600")
ac_outlet = Brep([<brep referenced from the Rhino model> x5])
mesh_area = MeshArea(Mesh=ac_outlet)  # -> Area, Centroid
division = Division(A="900", B=mesh_area.Area)
division_2 = Division(A=division, B=convert_1_h_1_s)
panel_4 = Panel("""{0,1,0}
{-1,0,0}
{-1,0,0}
{-1,0,0}
{-1,0,0}""")
center_2 = Center(Geometry=ac_outlet)  # -> Center, Dimension
multiplication_2 = Multiplication(A=mesh_area.Area, B=division_2)
multiplication_3 = Multiplication(A=panel_4, B=multiplication_2)
vector_display_ex_3 = VectorDisplayEx(Point=center_2.Center, Vector=multiplication_3, Colour=RGB(255, 0, 0), Width=2)

ac_inlet = Brep([<brep referenced from the Rhino model> x5])
face_normals_3 = FaceNormals(Mesh=ac_inlet)  # -> Centers, Normals
center_3 = Center(Geometry=ac_inlet)  # -> Center, Dimension
multiplication_4 = Multiplication(A=multiplication_2, B=-1)
multiplication_5 = Multiplication(A=face_normals_3.Normals, B=multiplication_4)
vector_display_ex_4 = VectorDisplayEx(Point=center_3.Center, Vector=multiplication_5, Colour=RGB(255, 0, 0), Width=2)

# ----
# Plates and mannequins 60 W heat source
infected_people = Brep([<brep referenced from the Rhino model> x149])
healthy_people = Brep([<brep referenced from the Rhino model> x1201])
plates = Brep([<brep referenced from the Rhino model> x91])
brep_join_2 = BrepJoin(Breps=[infected_people, healthy_people, plates])  # -> Breps, Closed

face_normals_4 = FaceNormals(Mesh=[ventilation_inlet_bathroom, ventilation_inlet_fire_stair_door])  # -> Centers, Normals
ventilation_inlet_bathroom_2 = Panel("-1.08")
ventilation_inlet_fire_stair_door_2 = Panel("-1.08")
multiplication_6 = Multiplication(A=face_normals_4.Normals, B=[ventilation_inlet_bathroom_2, ventilation_inlet_fire_stair_door_2])
vector_display_ex_5 = VectorDisplayEx(Point=face_normals_4.Centers, Vector=multiplication_6, Colour=RGB(255, 0, 0), Width=2)

panel_5 = Panel(division)

# ----
# Plane to Simulate Age of Air and CO2 concentration
age_of_air_simulation_plane_mouth_height = Brep(<brep referenced from the Rhino model>)

temp = Slider(33, range=27..35)
mesh = Mesh(brep_join_2.Breps)
pt_2 = Point(Point(3.152091326, -9.490595055, 0.4314200966))
mesh_2 = Mesh(mesh)
geo = Geometry(Geo=brep_join.Breps, Temp=temp)
ol = Outlet(Geo=ventilation_outlet, Vel=Vector(0, 0, 0))
vhs = VolumetricHeatSource(Geo=mesh_2, Power="60", Type=0)
il = Inlet(Geo=ventilation_inlet_bathroom, Vel=multiplication_6, Temp=temp)
idom = IndoorDomain(Geo=geo, Inlet=il, Outlet=ol, VolumetricHeatSource=vhs, Directory="C:\CovidRestaurant\", PointInside=pt_2, CellSize=1)
