# Grasshopper definition 99_ValidationCaseJiang2003.ghx (Grasshopper 1.0.7)
# plug-ins: Eddy3D

# Wind tunnel data
cluster = Cluster()
divide = DivideCurve(Curve=cluster, Count="50", Kinks=False)  # -> Points, Tangents, Parameters
# Jiang et al., 2003
# Uy/U_ref
panel = Panel("""0.1015
0.1869
0.2631
0.329
0.3837
0.4262
0.4554
0.4722
0.4733
0.4509
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""")
# z/H
panel_2 = Panel("""0.0408164
0.0816328
0.1224488
0.1632652
0.2040816
0.244898
0.2857144
0.3265308
0.3673468
0.408164
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""")
cluster_2 = Cluster_2(Y=panel, A=panel_2)
panel_3 = Panel("0.001")
rset = RunSettings(
    NumberOfIterations=1000,
    WriteInterval=20,
    NumberOfTimestepsToKeep=3,
    TurbulenceModel=3,
    RelaxationFactors=0,
    SolutionAndAlgorithmControl=1,
    PotentialFoamInitialization=False,
    NumberOfCPUs="1",
    OperatingSystem=0)
# Box-shaped simulation domain
panel_4 = Panel("180")
abl = ABL(WDir=panel_4, Uref="12", Zref="0.5", Z0="0.005", ZGround=0)
geo = Geometry(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)
# Cylindrical simulation domain
domaincyl = CylindricalDomain(Geometry=geo, BCond=abl, BlockSize="0.25")  # -> Domain, Mesh
button = Button()
domainbox = BoxShapedDomain(Geometry=geo, BoundaryCondition=abl, BlockSize="0.25")  # -> Domain, Mesh
cellsize = CellSize(SimulationDomain=domainbox.Domain, BlockSize="0.25", DesiredCellSize="0.01")
# Mesh
mset = MeshSettings(
    AccBuilding=cellsize,
    AccFeatures=cellsize,
    AccRefinement=cellsize,
    AccGround=cellsize,
    NLayer=Slider(6, range=0..10),
    Mode=2,
    Mode_2=2)
simulation = Simulation(
    SimulationDomain=domaincyl.Domain,
    WorkingDirectory="C:\ValidationJiang2003Cyl",
    MeshSettings=mset,
    RunSettings=rset,
    RunMeshing=Button(),
    RunSimulation=Button(),
    RunSimulation_2=False,
    runWithBlueCFD=True)
residuals = Residuals(Result=simulation, X=":", Y=":", Version=1, Run=Button(), visResiduals=True)
clean = Clean(Directory=simulation, Mode=2, Run=Button())
simulation_2 = Simulation(
    SimulationDomain=domainbox.Domain,
    WorkingDirectory="C:\ValidationJiang2003Box",
    MeshSettings=mset,
    RunSettings=rset,
    RunMeshing=button,
    MakeTrees=False,
    RunSimulation=button,
    runWithBlueCFD=True)
paraview = Paraview(Result=simulation, ParaviewVersion=2, Run=Button())
residuals_2 = Residuals(Result=simulation_2, X=":", Y=":", Version=1, Run=Button(), visResiduals=True)
clean_2 = Clean(ResultDirectory=simulation_2, Mode=2, Run=Button())
paraview_2 = Paraview(Result=simulation_2, ParaviewVersion=2, Run=Button())
visprobes = VisualizeProbes(Res=simulation, Points=divide.Points, Name="Validation", Field=0, Run=Button(), Culling=True)  # -> Points, Result
visprobes_2 = VisualizeProbes(Res=simulation_2, Points=divide.Points, Name="Validation", Field=0, Run=Button(), Culling=True)  # -> Points, Result
cluster_3 = Cluster_3(V_2=visprobes.Points, V=visprobes.Result)  # -> Z, R
cluster_4 = Cluster_3(V_2=visprobes_2.Points, V=visprobes_2.Result)  # -> Z, R
pt = ConstructPoint(XCoordinate=0, YCoordinate=cluster_3.R, ZCoordinate=cluster_3.Z)
pt_2 = ConstructPoint(XCoordinate=0, YCoordinate=cluster_4.R, ZCoordinate=cluster_4.Z)
graph = QuickGraph([pt, cluster_2], SortOrder=0)
graph_2 = QuickGraph([pt_2, cluster_2], SortOrder=0)

# ==== cluster Cluster
pt = ConstructPoint(XCoordinate="0.125", YCoordinate="0.125", ZCoordinate="0.5")
pt_2 = ConstructPoint(XCoordinate="0.125", YCoordinate="0.125", ZCoordinate="0.01")
ln = Line(StartPoint=pt_2, EndPoint=pt)
L = ClusterOutput(ln)

# ==== cluster Cluster_2
Y = ClusterInput()
A = ClusterInput()
division = Division(A=A, B="4")
pt = ConstructPoint(XCoordinate="0.125", YCoordinate=Y, ZCoordinate=division)
pt_2 = ClusterOutput(pt)

# ==== cluster Cluster_3
V = ClusterInput()
V_2 = ClusterInput()
devec = DeconstructVector(Vector=V)  # -> XComponent, YComponent, ZComponent
devec_2 = DeconstructVector(Vector=V_2)  # -> XComponent, YComponent, ZComponent
division = Division(A=devec.YComponent, B="12")
Z = ClusterOutput(devec_2.ZComponent)
R = ClusterOutput(division)
