# Grasshopper definition FluidX3D.gh (Grasshopper 1.0.8)
# plug-ins: Eddy3D

toggle = BooleanToggle(True)
brep = Brep(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)
fluidx3d = FluidX3DABLExperimental(
    BuildingGeometry=brep,
    FluidX3DSource="C:\Users\pkastner\AppData\Roaming\Eddy3D\Engines\FluidX3D",
    WorkingDirectory="C:\Users\pkastner\AppData\Local\Eddy3D\Cases",
    CloneUpdateSource=True,
    VRAMBudgetMB=1000,
    ReferenceVelocity=5,
    ReferenceHeight=10,
    RoughnessLength=0.1,
    SimulationTimeS="200",
    ExportEveryS=10,
    GroundElevation=0,
    MeshingEdgeLength=0,
    Prepare=toggle,
    Run=toggle)  # -> CaseDirectory, LaunchScript, ExportDirectory, Status
brep_2 = Brep(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)
qrmesh = QuadRemesh(Geometry=brep_2, Settings={aqc=True, as=50, dhe=True, gci=0, null=False, pme=2, sa=0, tqc=2000})
demesh = DeconstructMesh(Mesh=qrmesh)  # -> Vertices, Faces, Colours, Normals
fxprobe = FluidX3DProbeVTK(
    ExportDirectory=fluidx3d.ExportDirectory,
    ProbePoints=demesh.Vertices,
    Quantity=0,
    TimeMode=0,
    TargetTimeS=0,
    StartTimeS=0,
    EndTimeS=30,
    Run=Toggle(True))  # -> ProbePoints, UByTime, RhoByTime, UAverage, RhoAverage, SampledTimes, SampledSteps, SampledFiles, OutsideCount, Status
cluster = Cluster(data=fxprobe.UByTime)  # -> S, E, data_3
gradient = Gradient(
    LowerLimit=cluster.S,
    UpperLimit=cluster.E,
    Parameter=cluster.data_3,
    stops=[0.103: RGB(0, 0, 255), 0.22: RGB(0, 170, 255), 0.305: RGB(0, 255, 255), 0.398: RGB(0, 255, 188), 0.504: RGB(0, 255, 106), 0.605: RGB(91, 255, 0), 0.699: RGB(184, 255, 0), 0.799: RGB(255, 255, 0), 0.898: RGB(255, 170, 0)])
vdisex = VectorDisplayEx(Point=fxprobe.ProbePoints, Vector=fxprobe.UByTime, Colour=gradient, Width=Slider(3, range=0..10))

# ==== cluster Cluster
data = ClusterInput()
data_2 = Data(data)
data_3 = ClusterOutput(data_2)
bnd = Bounds(Numbers=data_2)
dedomain = DeconstructDomain(Domain=bnd)  # -> Start, End
S = ClusterOutput(dedomain.Start)
E = ClusterOutput(dedomain.End)
