# Grasshopper definition Radiation.gh (Grasshopper 1.0.7)
# plug-ins: Eddy3D

custom_mesh_settings = SettingsCustom(
    StitchSeams=True,
    SimplePlanes=False,
    Refine=True,
    MinCount=16,
    MaxCount=400,
    AspectRatio=20,
    MaxDistance=0,
    MaxAngle=20,
    MinEdge=0,
    MaxEdge=Slider(5, range=0..10))
brep = Brep(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)
geo = Geometry(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)
mesh = MeshBrep(Brep=brep, Settings=custom_mesh_settings)
mesh_2 = Mesh(geo)
rad = Radiation(
    Name="TEST",
    Dir="C:\Temp\Eddy3d",
    Weather="C:\DIVA\WeatherData\AUS_NT.Darwin.Airport.941200_RMY.epw",
    Model=mesh_2,
    Probes=mesh,
    Run=Button())
rad_2 = Radiation(Path=rad, Hour=12)  # -> Result, Meshes, Hour
