# Grasshopper definition testingEddyRadSim.gh (Grasshopper 1.0.7)
# plug-ins: ClimateStudioGH, Eddy3D

panel = Panel("""void plastic PlasterFloor_70
0
0
5 0.7 0.7 0.7 0 0 """)
brep = Brep([<brep referenced from the Rhino model> x6])
brep_2 = Brep(<brep referenced from the Rhino model>)
brep_3 = Brep(<brep referenced from the Rhino model>)
brep_4 = Brep(<brep referenced from the Rhino model>)
panel_2 = Panel("""10
12
14
16""")
custom_mesh_settings = SettingsCustom(
    StitchSeams=True,
    SimplePlanes=False,
    Refine=True,
    MinCount=16,
    MaxCount=400,
    AspectRatio=20,
    MaxDistance=0,
    MaxAngle=20,
    MinEdge="10",
    MaxEdge="10")
brep_5 = Brep(<brep referenced from the Rhino model>)
radsurf = RadiationSurface(Brep=brep, Patch="5", Material=panel, SimType=0)
ground = GroundSurface(Brep=brep_2, Patch="5", SimType=1)
tree = Tree(Brep=brep_3, Patch="5", Type=1, Temp=panel_2)
vegsurf = VegetationSurface(Brep=brep_4, Patch="5", SimType=0)
sen = Sensor(Point=Point(0, 0, 0), Normal=Vector(0, 0, 1))
mesh = MeshBrep(Brep=brep_5, Settings=custom_mesh_settings)
panel_3 = Panel("""{
  "ComputeReflectionsAndDiffuseRadiation": true,
  "CummulativeViewFactorCutoff": 0.2,
  "ComputeSurfaceTemperatureEnergyPlus": true,
  "ComputeLongWaveExchangeEnergyPlus": false
}""")
python = GhPythonScript(x=radsurf)  # -> out, a
# ---------- python: Python ----------
__author__ = "Timur"
__version__ = "2021.03.15"

import rhinoscriptsyntax as rs

a = x.TemperatureOverride
# ---------- end python ----------
rad = RadSystem(
    Name="MyStudy",
    Dir="C:\temp\Eddy 3d",
    Weather="C:\Eddy3D\Weather\USA_NY_New.York-LaGuardia.AP.725030_TMY3.epw",
    RSurf=[radsurf, tree, vegsurf, ground],
    Probes=[sen, mesh],
    Run=Button())  # -> RadSystem, Result
mrt = MRTSystem(
    Name="MyStudy",
    Dir="C:\Temp\Eddy3d",
    Weather="C:\Eddy3D\Weather\USA_NY_New.York-LaGuardia.AP.725030_TMY3.epw",
    RSurf=[radsurf, ground, tree, vegsurf],
    Sensors=[mesh, sen],
    Settings=panel_3,
    Run=Button())  # -> System, Result, Settings
lrad = LoadRadiation(Path=rad.Result, Load=Toggle(True))  # -> Result, Probes, Polys
hoy = HourOfYear(Month="6", Day=1, Hour="12")
panel_4 = Panel(mrt.Settings)
lrad_2 = LoadRadiation(Path=mrt.Result, Load=Toggle(True))  # -> Result, Probes, Polys
c_script = CSharpScript(x=lrad_2.Result, Reference="C:\EDDY3D\EddyLib.dll")  # -> out, A, B
# ---------- c_script: C# usings ----------
using EddyLib.Radiation;
# ---------- c_script: C# ----------
    MRT_Simulation_ResultProto res = (MRT_Simulation_ResultProto) x;


    var data = new List<double> ();
    var list = new List<Mesh> ();
    foreach (var p in res.Polys){
      data.Add(p.SeenByProbes);
      if(p.SeenByProbes > 0.1){
        list.Add(p.Mesh.Value);
      }
    }


    A = list;
    B = data;
# ---------- end c_script ----------
c_script_2 = CSharpScript(x=lrad.Result, h=hoy, Reference="C:\Eddy3D\EddyLib.dll")  # -> out, A, B; inputs h: Int32
# ---------- c_script_2: C# ----------
    MRT_Simulation_ResultProto res = (MRT_Simulation_ResultProto) x;
    var pts = new List<Point3d> ();

    var list = new List<float> ();

    foreach( var p in res.Probes) {

      list.Add(p.SolarGain_dMRT[h]);
      pts.Add(p.Point.Value);
    }
    A = list;
    B = pts;
# ---------- end c_script_2 ----------

c_script_3 = CSharpScript(x=lrad.Result, si="0", Reference="C:\EDDY3D\EddyLib.dll")  # -> out, A, B; inputs si: Int32
# ---------- c_script_3: C# ----------
    MRT_Simulation_ResultProto res = (MRT_Simulation_ResultProto) x;

    var list = new List<float> ();

    list.AddRange(res.Probes[res.Probes.Count - 1].SolarGain_dMRT);


    A = list;
    B = res.Probes[res.Probes.Count - 1].Point.Value;
# ---------- end c_script_3 ----------
gradient = GetCSGradient(Steps=0, UnitSystem=4)
bnd = Bounds(Numbers=c_script_3.A)
falsecolor = ConstructCSFalsecolor(GradientS=gradient, DomainS=bnd, UnitSystem=4)
plothr = CSPlotHourlyData(
    Data=c_script_3.A,
    Falsecolor=falsecolor,
    Input_0_Hidden=False,
    Input_0_Name="Data",
    Input_1_Hidden=False,
    Input_1_Name="Falsecolor",
    Input_2_Hidden=False,
    Input_2_Name="File Path",
    UnitSystem=4)

# ----
# comparing DDS simulation to weather file total horizontal radiation
weather = Weather(
    Location="USA_NY_New.York-LaGuardia.AP.725030_TMY3",
    Input_0_Hidden=False,
    Input_0_Name="Location",
    Output_0_Hidden=False,
    Output_0_Name="Location",
    Output_10_Hidden=False,
    Output_10_Name="DiffuseHorizontalRadiation",
    Output_11_Hidden=False,
    Output_11_Name="GlobalHorizontalRadiation",
    Output_12_Hidden=True,
    Output_12_Name="SkyCover",
    Output_13_Hidden=True,
    Output_13_Name="Precipitation",
    Output_14_Hidden=True,
    Output_14_Name="Elev",
    Output_15_Hidden=True,
    Output_15_Name="Azimuth",
    Output_16_Hidden=True,
    Output_16_Name="Vector",
    Output_17_Hidden=True,
    Output_17_Name="Illuminance",
    Output_18_Hidden=True,
    Output_18_Name="DateTime",
    Output_19_Hidden=True,
    Output_19_Name="DryBulbAverages",
    Output_1_Hidden=True,
    Output_1_Name="Latitude",
    Output_20_Hidden=True,
    Output_20_Name="DewPointAverages",
    Output_21_Hidden=True,
    Output_21_Name="DryBulbMinima"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)  # -> Location, DryBulbTemp, RelativeHumidity, DirectNormalRadiation, DiffuseHorizontalRadiation, GlobalHorizontalRadiation
c_script_4 = CSharpScript(x=lrad.Result, si="0", Reference="C:\EDDY3D\EddyLib.dll")  # -> out, A; inputs si: Int32
# ---------- c_script_4: C# ----------
    MRT_Simulation_ResultProto res = (MRT_Simulation_ResultProto) x;

    var list = new List<float> ();
    list.AddRange(res.Probes[si].DirRad);


    A = list;
# ---------- end c_script_4 ----------
c_script_5 = CSharpScript(x=lrad.Result, si="0", Reference="C:\Eddy3D\EddyLib.dll")  # -> out, A; inputs si: Int32
# ---------- c_script_5: C# ----------
    MRT_Simulation_ResultProto res = (MRT_Simulation_ResultProto) x;

    var list = new List<float> ();
    list.AddRange(res.Probes[si].TotalRad);

    A = list;
# ---------- end c_script_5 ----------
entwine = Entwine(
    Branch00=weather.GlobalHorizontalRadiation,
    Branch01=c_script_5.A,
    Branch02=c_script_4.A,
    Branch03=c_script_3.A,
    FlattenInputs=True)
panel_5 = Panel("""WeatherData
Simulation
Simulation Diffuse
SolarGain_dMRT""")
cluster = Cluster_2(doy=Slider(3, range=1..365))
subset = SubList(List=entwine, Domain=cluster, Wrap=True)  # -> List, Index
cluster_2 = Cluster(L=panel_5)  # -> C, R
xyplot = XYPlot(
    Type=0,
    Width=550,
    Height=450,
    Title="Radiation [W/m2]",
    X_rot=0,
    Y_data=subset.List,
    Colors=cluster_2.C,
    Names=panel_5,
    Show_xgrid=False,
    Show_ygrid=True,
    Legend=0)

bnd_2 = Bounds(Numbers=c_script_2.A)
inspectprobe = CSharpScript(x=lrad.Probes, si="0", Reference="C:\EDDY3D\EddyLib.dll")  # -> out, A, B, C; inputs x: list, si: Int32
# ---------- inspectprobe: C# usings ----------
using EddyLib.Radiation;
using System.Linq;
# ---------- inspectprobe: C# ----------
    EddyLib.Radiation.RProbe res = (EddyLib.Radiation.RProbe) x[si];

    var keylist = new List<string> ();

    var list = new List<double> ();

    list.AddRange(res.VFtoMaterial.Values.ToList());

    keylist.AddRange(res.VFtoMaterial.Keys.ToList());

    A = res.Point.Value;
    B = keylist;
    C = list;
# ---------- end inspectprobe ----------
dedomain = DeconstructDomain(Domain=bnd_2)  # -> Start, End
panel_6 = Panel([inspectprobe.B, inspectprobe.C])
gradient_2 = Gradient(
    LowerLimit=0,
    UpperLimit=dedomain.End,
    Parameter=c_script_2.A,
    stops=[0: RGB(0, 0, 255), 0.5: RGB(255, 255, 0), 1: RGB(255, 0, 0)])
panel_7 = Panel(bnd_2)
therm = Thermal(Res=lrad.Result, Run=Button())  # -> ThermSys, Result
lrad_3 = LoadRadiation(Path=therm.Result, Load=Toggle(True))  # -> Result, Probes, Polys
preview = CustomPreview(Geometry=c_script_2.B, Material=gradient_2)
comf = Comfort(MRTRes=lrad_3.Result, Run=Button())  # -> ComfSys, Result
lrad_4 = LoadRadiation(Path=comf.Result, Load=Toggle(True))  # -> Result, Probes, Polys
inspectprobe_2 = CSharpScript(x=lrad_4.Probes, si="0", Reference="C:\Eddy3D\EddyLib.dll")  # -> out, A, B, C; inputs x: list, si: Int32
# ---------- inspectprobe_2: C# ----------
    EddyLib.Radiation.RProbe res = (EddyLib.Radiation.RProbe) x[si];


    var list = new List<float> ();

    list.AddRange(res.UTCI);

    A = res.Point.Value;
    B = list;
    C = res.ComfortHours;
# ---------- end inspectprobe_2 ----------
c_script_6 = CSharpScript(x=lrad_4.Result, Reference="C:\EDDY3D\EddyLib.dll")  # -> out, A
# ---------- c_script_6: C# ----------
    MRT_Simulation_ResultProto res = (MRT_Simulation_ResultProto) x;



    A = res.Weather.WindSpeed;
# ---------- end c_script_6 ----------
comforthours = Panel(inspectprobe_2.C)
cluster_3 = Cluster_4(N=inspectprobe_2.B)  # -> F, I
cluster_4 = Cluster_3(N=c_script_6.A)
plothr_2 = CSPlotHourlyData(
    Data=c_script_6.A,
    Falsecolor=cluster_4,
    Input_0_Hidden=False,
    Input_0_Name="Data",
    Input_1_Hidden=False,
    Input_1_Name="Falsecolor",
    Input_2_Hidden=False,
    Input_2_Name="File Path",
    UnitSystem=4)
plothr_3 = CSPlotHourlyData(
    Data=inspectprobe_2.B,
    Falsecolor=cluster_3.F,
    Input_0_Hidden=False,
    Input_0_Name="Data",
    Input_1_Hidden=False,
    Input_1_Name="Falsecolor",
    Input_2_Hidden=False,
    Input_2_Name="File Path",
    UnitSystem=4)
panel_8 = Panel(cluster_3.I)

# ==== cluster Cluster
L = ClusterInput()
lng = ListLength(List=L)
series = Series(Start=0, Step=1, Count=lng)
gradient = Gradient(
    LowerLimit=0,
    UpperLimit=lng,
    Parameter=series,
    stops=[0: RGB(243, 57, 0), 0.1: RGB(236, 27, 60), 0.2: RGB(210, 0, 118), 0.3: RGB(103, 0, 120), 0.4: RGB(39, 72, 161), 0.5: RGB(1, 192, 229), 0.6: RGB(18, 178, 90), 0.7: RGB(79, 186, 8), 0.8: RGB(220, 237, 32), 0.9: RGB(247, 159, 20), 1: RGB(243, 57, 0)])
concat = Concatenate(FragmentA="Panel ", FragmentB=series)
C = ClusterOutput(gradient)
R = ClusterOutput(concat)

# ==== cluster Cluster_2
doy = ClusterInput()
md = MonthAndDay(DayOfYearIndex=doy)  # -> Month, Day
hoy = HourOfYear(Month=md.Month, Day=md.Day, Hour=1)
multiplication = Multiplication(A="24", B="7")
addition = Addition(A=hoy, B=multiplication)
dom = ConstructDomain(DomainStart=hoy, DomainEnd=addition)
I = ClusterOutput(dom)

# ==== cluster Cluster_3
N = ClusterInput()
gradient = GetCSGradient(Steps=0, UnitSystem=4)
bnd = Bounds(Numbers=N)
falsecolor = ConstructCSFalsecolor(GradientS=gradient, DomainS=bnd, UnitSystem=4)
F = ClusterOutput(falsecolor)

# ==== cluster Cluster_4
N = ClusterInput()
gradient = GetCSGradient(Steps=0, UnitSystem=4)
bnd = Bounds(Numbers=N)
falsecolor = ConstructCSFalsecolor(GradientS=gradient, DomainS=bnd, UnitSystem=4)
I = ClusterOutput(bnd)
F = ClusterOutput(falsecolor)
