# Grasshopper definition testingEddyRadSim_v2.gh (Grasshopper 1.0.7)
# plug-ins: ClimateStudioGH, Eddy3D

panel = Panel("""void plastic PlasterFloor_70
0
0
5 0.7 0.7 0.7 0 0 """)
treeset = TreeSettings()
surfset = SurfaceSettings(
    Name="BADABUM",
    Thickness=0.1,
    Conductivity=2.3,
    Density=2400,
    SpecificHeat=840,
    ThermalAbsorptance=0.9,
    SolarAbsorptance=0.7,
    VisibleAbsorptance=0.7,
    Surface=panel)
vegset = VegetationSettings(Name="bla", HeightPlants=0.5, LeafAreaIndex=5, LeafReflectivity=0.2, LeafEmissivity=0.95, MinimumStomatalResistance=180)
panel_2 = Panel(surfset)
panel_3 = Panel(vegset)
crv = Curve(<curve referenced from the Rhino model>)
custom_mesh_settings = SettingsCustom(
    StitchSeams=True,
    SimplePlanes=False,
    Refine=True,
    MinCount=16,
    MaxCount=400,
    AspectRatio=20,
    MaxDistance=0,
    MaxAngle=20,
    MinEdge="4",
    MaxEdge="4")
brep = Brep(crv)
brep_2 = Brep([<brep referenced from the Rhino model> x6])
brep_3 = Brep(<brep referenced from the Rhino model>)
brep_4 = Brep(<brep referenced from the Rhino model>)
brep_5 = Brep(<brep referenced from the Rhino model>)
qrsettings = QuadRemeshSettings(TargetCount="150", AdaptiveSize=0, AdaptiveCount=False, HardEdges=False, SeamEdges=0, Symmetry=0, GuideCurves=0)
panel_4 = Panel("""0
45
90
135
180
225
270
315""")
mesh = MeshBrep(Brep=brep, Settings=custom_mesh_settings)  # disabled
qrmesh = QuadRemesh(Mesh=brep, Settings=qrsettings)
t_leaf_2018 = Number([-17.14444, -17.14444, -17.62523, -17.63942, -17.63942, -18.23187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])
quad = Quadrangulate(Mesh=mesh, Angle=0.03490658504, Ratio=0.875)  # -> Mesh, Count; disabled
vegsurf = VegetationSurface(Brep=brep_5, Patch="5", Material=vegset, SimType=0)
radsurf = RadiationSurface(Brep=brep_2, Patch="5", Settings=surfset, SimType=0)
ground = GroundSurface(Brep=brep_4, Patch="5", SimType=0)
tree = Tree(Brep=brep_3, Patch=3, Settings=treeset, SimType=2, Temp=t_leaf_2018)
uniform_flow = UniformFlow(WindDirections=panel_4, ReferenceVelocity_m_s=5, SurfaceRoughnessHeight_m=1)
# 2. Simulation Domain
geo = Geometry([brep_2, brep_4, brep_3, brep_5])
mesh_2 = Mesh(<mesh referenced from the Rhino model>)
python = GhPythonScript(x=[radsurf, ground])  # -> out, a
# ---------- python: Python ----------
__author__ = "Timur"
__version__ = "2021.03.20"

import rhinoscriptsyntax as rs

a = x.HighPoly
# ---------- end python ----------
volume = Volume(Geometry=mesh_2)  # -> Volume, Centroid
domaincyl = CylindricalDomain(Geometry=geo, BoundaryCondition=uniform_flow, BlockSize=20, SizeOfOuterRadius=Slider(1000, range=0..1000))  # -> Domain, Mesh
pt = Point(volume.Centroid)
sen = Sensor(Point=pt, Normal=Vector(0, 0, 1), Mesh=mesh_2)
set = Settings(
    ComputeReflectionsAndDiffuseRadiation=Toggle(False),
    CummulativeViewFactorCutoff=" 0.01",
    ComputeSurfaceTemperatureEnergyPlus=Toggle(True),
    ComputeLongWaveExchangeEnergyPlus=False)
panel_5 = Panel(set)
mrt = MRTSystem(
    Name="MyStudy",
    Dir="C:\Temp\Eddy3d",
    Weather="C:\Eddy3D\Weather\USA_NY_New.York-LaGuardia.AP.725030_TMY3.epw",
    RSurf=[radsurf, ground, tree, vegsurf],
    Sensors=[qrmesh, sen],
    Settings=set,
    Run=Button())  # -> System, Result, Settings
clean = Clean(ResultDirectory="C:\temp\Eddy3D\Wind", Mode=2, Run=Button())

# ----
# 4. Probing points & probing
number_slider = Slider(17, range=1..30)
brep_6 = Brep(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)
mjoin = MeshJoin(Meshes=geo)
brep_7 = Brep(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)

lrad = LoadRadiation(Path=mrt.Result, Load=Toggle(True))  # -> Result, Probes, Polys
hoy = HourOfYear(Month=Slider(4, range=0..12), Day=1, Hour=Slider(16, range=0..24))
cluster = Cluster_4(bm=mjoin, brep=brep_6, number=number_slider)
sen_2 = Sensor(Point=cluster, Normal=Vector(0, 0, 1))
inpoly = InspectPolygon(Polygon=lrad.Polys, Metric=0, Index=hoy, type="Hour")  # -> Point, Mesh, Data
comf = Comfort(MRTRes=lrad.Result, Run=Button())  # -> ComfSys, Result
lrad_2 = LoadRadiation(Path=comf.Result, Load=Toggle(False))  # -> Result, Probes, Polys
bnd = Bounds(Numbers=inpoly.Data)
hoy_2 = HourOfYear(Month=Slider(5, range=0..12), Day=1, Hour=Slider(14, range=0..24))
dedomain = DeconstructDomain(Domain=bnd)  # -> Start, End

insen = InspectSensor(Sensor=lrad_2.Probes, Metric=0, Index="0", type="Sensor")  # -> Point, Mesh, Data
gradient = GetCSGradient(Steps=0, UnitSystem=4)
dom = ConstructDomain(DomainStart="-40", DomainEnd="46")
swatch = ColourSwatch(SwatchColor=RGB(0, 0, 0))
falsecolor = ConstructCSFalsecolor(GradientS=gradient, DomainS=dom, BelowColor=swatch, AboveColor=swatch, UnitSystem=4)
plothr = CSPlotHourlyData(
    Data=insen.Data,
    Falsecolor=falsecolor,
    Input_0_Hidden=False,
    Input_0_Name="Data",
    Input_1_Hidden=False,
    Input_1_Name="Falsecolor",
    Input_2_Hidden=False,
    Input_2_Name="File Path",
    UnitSystem=4)

insen_2 = InspectSensor(Sensor=lrad.Probes, Metric=1, Index=hoy_2, type="Hour")  # -> Point, Mesh, Data
inspectprobe = CSharpScript(x=lrad.Probes, si="0", Reference="C:\EDDY3D\EddyLib.dll")  # -> out, A, B, C; inputs x: list, si: Int32
# ---------- inspectprobe: C# usings ----------
using EddyLib.Radiation;
using System.Linq;
# ---------- inspectprobe: C# ----------
    EddyLib.Radiation.RProbe res = (EddyLib.Radiation.RProbe) x[si];

    var keylist = new List<string> ();

    var list = new List<double> ();

    list.AddRange(res.VFtoMaterial.Values.ToList());

    keylist.AddRange(res.VFtoMaterial.Keys.ToList());

    A = res.Point.Value;
    B = keylist;
    C = list;
# ---------- end inspectprobe ----------
gradient_2 = Gradient(
    LowerLimit=dedomain.Start,
    UpperLimit=dedomain.End,
    Parameter=inpoly.Data,
    stops=[0: RGB(0, 0, 255), 0.5: RGB(255, 255, 0), 1: RGB(255, 0, 0)])
panel_6 = Panel(bnd)
tag = TextTag(Location=inpoly.Point, Text=inpoly.Data, Colour=gradient_2)
panel_7 = Panel([inspectprobe.B, inspectprobe.C])

# ----
# comparing DDS simulation to weather file total horizontal radiation
weather = Weather(
    Location="USA_NY_New.York-LaGuardia.AP.725030_TMY3",
    Input_0_Hidden=False,
    Input_0_Name="Location",
    Output_0_Hidden=False,
    Output_0_Name="Location",
    Output_10_Hidden=False,
    Output_10_Name="DiffuseHorizontalRadiation",
    Output_11_Hidden=False,
    Output_11_Name="GlobalHorizontalRadiation",
    Output_12_Hidden=True,
    Output_12_Name="SkyCover",
    Output_13_Hidden=True,
    Output_13_Name="Precipitation",
    Output_14_Hidden=True,
    Output_14_Name="Elev",
    Output_15_Hidden=True,
    Output_15_Name="Azimuth",
    Output_16_Hidden=True,
    Output_16_Name="Vector",
    Output_17_Hidden=True,
    Output_17_Name="Illuminance",
    Output_18_Hidden=True,
    Output_18_Name="DateTime",
    Output_19_Hidden=True,
    Output_19_Name="DryBulbAverages",
    Output_1_Hidden=True,
    Output_1_Name="Latitude",
    Output_20_Hidden=True,
    Output_20_Name="DewPointAverages",
    Output_21_Hidden=True,
    Output_21_Name="DryBulbMinima"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)  # -> Location, DryBulbTemp, RelativeHumidity, DirectNormalRadiation, DiffuseHorizontalRadiation, GlobalHorizontalRadiation
c_script = CSharpScript(x=lrad.Result, si="51", Reference="C:\Eddy3D\EddyLib.dll")  # -> out, A, B; inputs si: Int32
# ---------- c_script: C# usings ----------
using EddyLib.Radiation;
# ---------- c_script: C# ----------
    MRT_Simulation_ResultProto res = (MRT_Simulation_ResultProto) x;

    var list = new List<float> ();
    list.AddRange(res.Probes[si].TotalRad);

    A = list;
    B = res.Probes[si].Point.Value;
# ---------- end c_script ----------
entwine = Entwine(Branch00=weather.GlobalHorizontalRadiation, Branch01=c_script.A, FlattenInputs=True)
panel_8 = Panel("""WeatherData
Simulation
SolarGain_dMRT""")
cluster_2 = Cluster_2(doy=Slider(105, range=1..365))
cluster_3 = Cluster(L=panel_8)  # -> C, R
subset = SubList(List=entwine, Domain=cluster_2, Wrap=True)  # -> List, Index
xyplot = XYPlot(
    Type=0,
    Width=550,
    Height=450,
    Title="Radiation [W/m2]",
    X_rot=0,
    Y_data=subset.List,
    Colors=cluster_3.C,
    Names=panel_8,
    Show_xgrid=False,
    Show_ygrid=True,
    Legend=0)

preview = CustomPreview(Geometry=inpoly.Mesh, Material=gradient_2)
bnd_2 = Bounds(Numbers=insen_2.Data)
dedomain_2 = DeconstructDomain(Domain=bnd_2)  # -> Start, End
gradient_3 = Gradient(
    LowerLimit=dedomain_2.Start,
    UpperLimit=dedomain_2.End,
    Parameter=insen_2.Data,
    stops=[0: RGB(0, 0, 255), 0.5: RGB(255, 255, 0), 1: RGB(255, 0, 0)])
panel_9 = Panel(bnd_2)
preview_2 = CustomPreview(Geometry=insen_2.Mesh, Material=gradient_3)

# ----
# 3. Mesh & Simulation
panel_10 = Panel("100")
rset = RunSettings(
    NumberOfIterations=panel_10,
    WriteInterval=20,
    NumberOfTimestepsToKeep=3,
    TurbulenceModel=1,
    RelaxationFactors=3,
    SolutionAndAlgorithmControl=0,
    PotentialFoamInitialization=False,
    AgeOfAir=False,
    NumberOfCPUs="2",
    OperatingSystem=0)

mset = MeshSettings(AccBuilding=2, AccFeatures="3", AccBBox=0, AccGround="3", MiscSettings=1, NumberOfLayers=4, Mode=2)

simulation = Simulation(
    SimulationDomain=domaincyl.Domain,
    WorkingDirectory="C:\temp\Eddy3D\Wind",
    MeshSettings=mset,
    RunSettings=rset,
    RunMeshing=Button(),
    MakeTrees=False,
    RunSimulation=Button(),
    runWithBlueCFD=True)
residuals = Residuals(Result=simulation, X=":", Y=":", Version=1, Run=Button(), visResiduals=True)

wprobes = WProbes(Result=simulation, Sensors=sen_2, NameOfInstance="ttt", Run=Button())
mrt_2 = LoadMRT(Path=wprobes, Load=Toggle(True))  # -> Result, Probes
item = ListItem(List=mrt_2.Probes, Index=0, Wrap=True)
python_2 = GhPythonScript(x=item)  # -> out, flatten(a)
# ---------- python_2: Python ----------
__author__ = "pkastner"
__version__ = "2021.03.17"

import rhinoscriptsyntax as rs

a = x.U[0].Value
# ---------- end python_2 ----------
loadwind = LoadWind(Path=mrt_2.Result, EPW="C:\DIVA\WeatherData\AUS_NSW.Sydney.947670_IWEC.epw", Load=Toggle(True))  # -> Result, Probes
panel_11 = Panel(python_2.a)
item_2 = ListItem(List=loadwind.Probes, Index=0, Wrap=True)
python_3 = GhPythonScript(x=item_2)  # -> out, flatten(a); same code as python_2
panel_12 = Panel(python_3.a)

# ==== cluster Cluster
L = ClusterInput()
lng = ListLength(List=L)
series = Series(Start=0, Step=1, Count=lng)
gradient = Gradient(
    LowerLimit=0,
    UpperLimit=lng,
    Parameter=series,
    stops=[0: RGB(243, 57, 0), 0.1: RGB(236, 27, 60), 0.2: RGB(210, 0, 118), 0.3: RGB(103, 0, 120), 0.4: RGB(39, 72, 161), 0.5: RGB(1, 192, 229), 0.6: RGB(18, 178, 90), 0.7: RGB(79, 186, 8), 0.8: RGB(220, 237, 32), 0.9: RGB(247, 159, 20), 1: RGB(243, 57, 0)])
concat = Concatenate(FragmentA="Panel ", FragmentB=series)
C = ClusterOutput(gradient)
R = ClusterOutput(concat)

# ==== cluster Cluster_2
doy = ClusterInput()
md = MonthAndDay(DayOfYearIndex=doy)  # -> Month, Day
hoy = HourOfYear(Month=md.Month, Day=md.Day, Hour=1)
multiplication = Multiplication(A="24", B="7")
addition = Addition(A=hoy, B=multiplication)
dom = ConstructDomain(DomainStart=hoy, DomainEnd=addition)
I = ClusterOutput(dom)

# ==== cluster Cluster_4
brep = ClusterInput()
number = ClusterInput()
cluster = Cluster_3(brep=brep, number=number)
bm = ClusterInput()
probing = Probing(BuildingMesh=bm, GroundMesh=cluster, ConvertQuadsToTriangles=False)
demesh = DeconstructMesh(Mesh=probing)  # -> Vertices, Faces, Colours, Normals
V = ClusterOutput(demesh.Vertices)

# ==== cluster Cluster_3
number = ClusterInput()
number_2 = Number(number)
settings_custom = SettingsCustom(
    StitchSeams=True,
    SimplePlanes=False,
    Refine=True,
    MinCount=16,
    MaxCount=400,
    AspectRatio=20,
    MaxDistance=0,
    MaxAngle=20,
    MinEdge=number_2,
    MaxEdge=number_2)
brep = ClusterInput()
mesh_brep = MeshBrep(Brep=brep, Settings=settings_custom)
mesh = ClusterOutput(mesh_brep)
