# Grasshopper definition testingStreetCanyons.gh (Grasshopper 1.0.7)
# plug-ins: ClimateStudioGH, Eddy3D

# Setup Rad and Temperature Surfaces
brep = Brep([<brep referenced from the Rhino model> x4])
brep_2 = Brep([<brep referenced from the Rhino model> x2])
ground = GroundSurface(Brep=brep_2, Patch="5", SimType=0)
radsurf = RadiationSurface(Brep=brep, Patch="5", SimType=0)  # disabled
python = GhPythonScript(x=[radsurf, ground])  # -> out, a
# ---------- python: Python ----------
__author__ = "Timur"
__version__ = "2021.03.20"

import rhinoscriptsyntax as rs

a = x.HighPoly
# ---------- end python ----------
number_slider = Slider(1000, range=0..1000)  # disabled

# ----
# Simulation Domain
panel = Panel("""0
45
90
135
180
225
270
315""")  # disabled
uniform_flow = UniformFlow(WindDirections=panel, ReferenceVelocity_m_s=5, SurfaceRoughnessHeight_m=1)  # disabled
geo = Geometry([brep, brep_2])  # disabled
domaincyl = CylindricalDomain(Geometry=geo, BoundaryCondition=uniform_flow, BlockSize=20, SizeOfOuterRadius=number_slider)  # -> Domain, Mesh; disabled

button = Button()  # disabled
button_2 = Button()  # disabled
button_3 = Button()  # disabled
path = FilePath("C:\Eddy3D\Weather\USA_CA_Los.Angeles.Intl.AP.722950_TMY3.epw")
c_script = CSharpScript(x=path, Reference="C:\Eddy3D\EddyLib.dll")  # -> out, A; inputs x: String
# ---------- c_script: C# usings ----------
using EddyLib;
# ---------- c_script: C# ----------
    var w = new EddyLib.Weather(x);
    
    A = w.DryBulbTemp;
# ---------- end c_script ----------
panel_2 = Panel(c_script.A)
swatch = ColourSwatch(SwatchColor=RGB(0, 0, 0))
gradient = GetCSGradient(Steps=0, UnitSystem=4)
swatch_2 = ColourSwatch(SwatchColor=RGB(0, 0, 0))
gradient_2 = GetCSGradient(Steps=0, UnitSystem=4)
dom = ConstructDomain(DomainStart="-5", DomainEnd="5")
dom_2 = ConstructDomain(DomainStart="-5", DomainEnd="5")
panel_3 = Panel("0.29")
falsecolor = ConstructCSFalsecolor(GradientS=gradient, DomainS=dom, BelowColor=swatch, AboveColor=swatch, UnitSystem=4)
falsecolor_2 = ConstructCSFalsecolor(GradientS=gradient_2, DomainS=dom_2, BelowColor=swatch_2, AboveColor=swatch_2, UnitSystem=4)
set = Settings(
    ComputeReflectionsAndDiffuseRadiation=Toggle(True),
    CummulativeViewFactorCutoff=" 0.001",
    ComputeSurfaceTemperatureEnergyPlus=Toggle(True),
    ComputeLongWaveExchangeEnergyPlus=False,
    WindScaling="0.15")
panel_4 = Panel(set)

cluster = Cluster_3(S="-5", F=falsecolor)  # -> col_2, L
legend = Legend(Colour=cluster.col_2, Tags=cluster.L, LegendType=1)

# ----
# Setup Probes
panel_5 = Panel("150")
qrsettings = QuadRemeshSettings(TargetCount=panel_5, AdaptiveSize=0, AdaptiveCount=False, HardEdges=False, SeamEdges=0, Symmetry=0, GuideCurves=0)
brep_3 = Brep([<brep referenced from the Rhino model> x2])
qrmesh = QuadRemesh(Mesh=brep_3, Settings=qrsettings)
sen = Sensor(Mesh=qrmesh)

area = Area(Geometry=brep_3)  # -> Area, Centroid
sen_2 = Sensor(Point=area.Centroid, Normal=Vector(0, 0, 1), Mesh=qrmesh)

entwine = Entwine(Branch00=sen_2, FlattenInputs=True)  # -> flatten(Result)

mrt = MRTSystem(Dir="C:\Temp\streetCanyons", Weather=path, RSurf=[radsurf, ground], Sensors=entwine, Settings=set, Run=Button())  # -> System, Result, Settings
lrad = LoadRadiation(Path=mrt.Result, Load=Toggle(True))  # -> Result, Probes, Polys

# ----
# Explode VFs
panel_6 = Panel("0")
inspectprobe = CSharpScript(x=lrad.Probes, si=panel_6, Reference="C:\EDDY3D\EddyLib.dll")  # -> out, A, B, C; inputs x: list, si: Int32
# ---------- inspectprobe: C# usings ----------
using EddyLib.Radiation;
using System.Linq;
# ---------- inspectprobe: C# ----------
    EddyLib.Radiation.RProbe res = (EddyLib.Radiation.RProbe) x[si];

    var keylist = new List<string> ();

    var list = new List<double> ();

    list.AddRange(res.VFtoMaterial.Values.ToList());

    keylist.AddRange(res.VFtoMaterial.Keys.ToList());

    A = res.Point.Value;
    B = keylist;
    C = list;
# ---------- end inspectprobe ----------
panel_7 = Panel([inspectprobe.B, inspectprobe.C])

# ----
# Inpsect Probe Data [1 probe - full year]
panel_8 = Panel("0")
insen = InspectSensor(Sensor=lrad.Probes, Metric=0, Index=panel_8, type="Sensor")  # -> Point, Mesh, Data
dom_3 = ConstructDomain(DomainStart="-40", DomainEnd="46")
gradient_3 = GetCSGradient(Steps=0, UnitSystem=4)
falsecolor_3 = ConstructCSFalsecolor(
    GradientS=gradient_3,
    DomainS=dom_3,
    BelowColor=ColourSwatch(SwatchColor=RGB(255, 255, 255)),
    AboveColor=ColourSwatch(SwatchColor=RGB(0, 0, 0)),
    UnitSystem=4)
plothr = CSPlotHourlyData(
    Data=insen.Data,
    Falsecolor=falsecolor_3,
    Input_0_Hidden=False,
    Input_0_Name="Data",
    Input_1_Hidden=False,
    Input_1_Name="Falsecolor",
    Input_2_Hidden=False,
    Input_2_Name="File Path",
    UnitSystem=4)

# ----
# Inpsect Probe Data [1 probe - full year]
panel_9 = Panel("1")
insen_2 = InspectSensor(Sensor=lrad.Probes, Metric=0, Index=panel_9, type="Sensor")  # -> Point, Mesh, Data
dom_4 = ConstructDomain(DomainStart="-40", DomainEnd="46")
gradient_4 = GetCSGradient(Steps=0, UnitSystem=4)
falsecolor_4 = ConstructCSFalsecolor(
    GradientS=gradient_4,
    DomainS=dom_4,
    BelowColor=ColourSwatch(SwatchColor=RGB(255, 255, 255)),
    AboveColor=ColourSwatch(SwatchColor=RGB(0, 0, 0)),
    UnitSystem=4)
plothr_2 = CSPlotHourlyData(
    Data=insen_2.Data,
    Falsecolor=falsecolor_4,
    Input_0_Hidden=False,
    Input_0_Name="Data",
    Input_1_Hidden=False,
    Input_1_Name="Falsecolor",
    Input_2_Hidden=False,
    Input_2_Name="File Path",
    UnitSystem=4)

# ----
# Inpsect Probe Data [all probes - one hour]
number_slider_2 = Slider(4, range=0..12)
hoy = HourOfYear(Month=number_slider_2, Day=1, Hour=Slider(8, range=0..24))
insen_3 = InspectSensor(Sensor=lrad.Probes, Metric=1, Index=hoy, type="Hour")  # -> Point, Mesh, Data
bnd = Bounds(Numbers=insen_3.Data)
dedomain = DeconstructDomain(Domain=bnd)  # -> Start, End
panel_10 = Panel(bnd)
gradient_5 = Gradient(
    LowerLimit=dedomain.Start,
    UpperLimit=dedomain.End,
    Parameter=insen_3.Data,
    stops=[0: RGB(0, 0, 255), 0.5: RGB(255, 255, 0), 1: RGB(255, 0, 0)])
preview = CustomPreview(Geometry=insen_3.Mesh, Material=gradient_5)

# ----
# Inspect Air Speed
panel_11 = Panel("0")
insen_4 = InspectSensor(Sensor=lrad.Probes, Metric=6, Index=panel_11, type="Sensor")  # -> Point, Mesh, Data
dom_5 = ConstructDomain(DomainStart="0", DomainEnd="10")
gradient_6 = GetCSGradient(Steps=0, UnitSystem=4)
falsecolor_5 = ConstructCSFalsecolor(
    GradientS=gradient_6,
    DomainS=dom_5,
    BelowColor=ColourSwatch(SwatchColor=RGB(255, 255, 255)),
    AboveColor=ColourSwatch(SwatchColor=RGB(255, 92, 171)),
    UnitSystem=4)
plothr_3 = CSPlotHourlyData(
    Data=insen_4.Data,
    Falsecolor=falsecolor_5,
    Input_0_Hidden=False,
    Input_0_Name="Data",
    Input_1_Hidden=False,
    Input_1_Name="Falsecolor",
    Input_2_Hidden=False,
    Input_2_Name="File Path",
    UnitSystem=4)

# ----
# Inspect Surface Temperatures
number_slider_3 = Slider(4, range=0..12)
hoy_2 = HourOfYear(Month=number_slider_3, Day=1, Hour=Slider(16, range=0..24))
inpoly = InspectPolygon(Polygon=lrad.Polys, Metric=0, Index=hoy_2, type="Hour")  # -> Point, Mesh, Data
bnd_2 = Bounds(Numbers=inpoly.Data)
dedomain_2 = DeconstructDomain(Domain=bnd_2)  # -> Start, End
panel_12 = Panel(bnd_2)
gradient_7 = Gradient(
    LowerLimit=dedomain_2.Start,
    UpperLimit=dedomain_2.End,
    Parameter=inpoly.Data,
    stops=[0: RGB(0, 0, 255), 0.5: RGB(255, 255, 0), 1: RGB(255, 0, 0)])
tag = TextTag(Location=inpoly.Point, Text=inpoly.Data, Colour=gradient_7)
preview_2 = CustomPreview(Geometry=inpoly.Mesh, Material=gradient_7)

# ----
# Inspect Surface Temperatures [all hours]
inpoly_2 = InspectPolygon(Polygon=lrad.Polys, Metric=0, Index=Slider(36, range=0..300), type="Polygon")  # -> Point, Mesh, Data
bnd_3 = Bounds(Numbers=inpoly_2.Data)
dedomain_3 = DeconstructDomain(Domain=bnd_3)  # -> Start, End
panel_13 = Panel(dedomain_3.Start)
panel_14 = Panel(dedomain_3.End)
gradient_8 = GetCSGradient(Steps=0, UnitSystem=4)
dom_6 = ConstructDomain(DomainStart=panel_13, DomainEnd=panel_14)
falsecolor_6 = ConstructCSFalsecolor(
    GradientS=gradient_8,
    DomainS=dom_6,
    BelowColor=ColourSwatch(SwatchColor=RGB(255, 255, 255)),
    AboveColor=ColourSwatch(SwatchColor=RGB(255, 92, 171)),
    UnitSystem=4)
plothr_4 = CSPlotHourlyData(
    Data=inpoly_2.Data,
    Falsecolor=falsecolor_6,
    Input_0_Hidden=False,
    Input_0_Name="Data",
    Input_1_Hidden=False,
    Input_1_Name="Falsecolor",
    Input_2_Hidden=False,
    Input_2_Name="File Path",
    UnitSystem=4)

bnd_4 = Bounds(Numbers=insen_4.Data)
points = PointList(Points=inpoly_2.Point)

# ----
# UTCI Comfort Autonomy for selected hours
panel_15 = Panel("1")
utci = UTCIRating(UTCI=insen.Data)
abins = AnalysisBins(From=panel_15, To="365", Start="8", End="18")  # -> HOY, DateTime
item = ListItem(List=utci, Index=abins.HOY, Wrap=True)
python_2 = GhPythonScript(x=item)  # -> out, a
# ---------- python_2: Python ----------
__author__ = "Timur"
__version__ = "2021.03.31"

import rhinoscriptsyntax as rs

a = int (x<1 and x>-1)
# ---------- end python_2 ----------
lng = ListLength(List=item)
ma = MassAddition(Input=python_2.a)  # -> Result, PartialResults
division = Division(A=ma.Result, B=lng)
panel_16 = Panel(division)

# ----
# UTCI Comfort Autonomy for selected hours
panel_17 = Panel("1")
utci_2 = UTCIRating(UTCI=insen_2.Data)
abins_2 = AnalysisBins(From=panel_17, To="365", Start="8", End="18")  # -> HOY, DateTime
item_2 = ListItem(List=utci_2, Index=abins_2.HOY, Wrap=True)
python_3 = GhPythonScript(x=item_2)  # -> out, a; same code as python_2
lng_2 = ListLength(List=item_2)
ma_2 = MassAddition(Input=python_3.a)  # -> Result, PartialResults
division_2 = Division(A=ma_2.Result, B=lng_2)
panel_18 = Panel(division_2)

plothr_5 = CSPlotHourlyData(
    Data=utci,
    Falsecolor=falsecolor,
    Input_0_Hidden=False,
    Input_0_Name="Data",
    Input_1_Hidden=False,
    Input_1_Name="Falsecolor",
    Input_2_Hidden=False,
    Input_2_Name="File Path",
    UnitSystem=4)
plothr_6 = CSPlotHourlyData(
    Data=utci_2,
    Falsecolor=falsecolor_2,
    Input_0_Hidden=False,
    Input_0_Name="Data",
    Input_1_Hidden=False,
    Input_1_Name="Falsecolor",
    Input_2_Hidden=False,
    Input_2_Name="File Path",
    UnitSystem=4)

# ----
# Mesh & Simulation
panel_19 = Panel("C:\temp\Eddy3D\Wind")  # disabled
panel_20 = Panel("100")  # disabled
panel_21 = Panel("3")  # disabled
button_4 = Button()  # disabled
panel_22 = Panel("2")  # disabled
rset = RunSettings(
    NumberOfIterations=panel_20,
    WriteInterval=20,
    NumberOfTimestepsToKeep=3,
    TurbulenceModel=1,
    RelaxationFactors=3,
    SolutionAndAlgorithmControl=0,
    PotentialFoamInitialization=False,
    AgeOfAir=False,
    NumberOfCPUs=panel_22,
    OperatingSystem=0)  # disabled

mset = MeshSettings(AccBuilding=2, AccFeatures=panel_21, AccBBox=0, AccGround=panel_21, MiscSettings=1, NumberOfLayers=4, Mode=2)  # disabled

simulation = Simulation(
    SimulationDomain=domaincyl.Domain,
    WorkingDirectory=panel_19,
    MeshSettings=mset,
    RunSettings=rset,
    RunMeshing=button,
    MakeTrees=False,
    RunSimulation=button_2,
    runWithBlueCFD=True)  # disabled
residuals = Residuals(Result=simulation, X=":", Y=":", Version=1, Run=button_4, visResiduals=True)  # disabled

# ----
# Probing points & probing
panel_23 = Panel("ttt")  # disabled
wprobes = WProbes(Result=simulation, Sensors=entwine, NameOfInstance=panel_23, Run=button_3)  # disabled

# ----
# Comparing UTCI weather to UTCI Sim
weather = Weather(
    Location=path,
    Input_0_Hidden=False,
    Input_0_Name="Location",
    Output_0_Hidden=False,
    Output_0_Name="Location",
    Output_10_Hidden=False,
    Output_10_Name="DiffuseHorizontalRadiation",
    Output_11_Hidden=False,
    Output_11_Name="GlobalHorizontalRadiation",
    Output_12_Hidden=True,
    Output_12_Name="SkyCover",
    Output_13_Hidden=True,
    Output_13_Name="Precipitation",
    Output_14_Hidden=True,
    Output_14_Name="Elev",
    Output_15_Hidden=True,
    Output_15_Name="Azimuth",
    Output_16_Hidden=True,
    Output_16_Name="Vector",
    Output_17_Hidden=True,
    Output_17_Name="Illuminance",
    Output_18_Hidden=True,
    Output_18_Name="DateTime",
    Output_19_Hidden=True,
    Output_19_Name="DryBulbAverages",
    Output_1_Hidden=True,
    Output_1_Name="Latitude",
    Output_20_Hidden=True,
    Output_20_Name="DewPointAverages",
    Output_21_Hidden=True,
    Output_21_Name="DryBulbMinima"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)  # -> Location, DryBulbTemp, RelativeHumidity, WindSpeed, DirectNormalRadiation, DiffuseHorizontalRadiation, GlobalHorizontalRadiation
c_script_2 = CSharpScript(x=lrad.Result, si="0", Reference="C:\Eddy3D\EddyLib.dll")  # -> UTCI; inputs si: Int32
# ---------- c_script_2: C# usings ----------
using EddyLib.Radiation;
# ---------- c_script_2: C# ----------
    MRT_Simulation_ResultProto res = (MRT_Simulation_ResultProto) x;

 

    UTCI = res.Probes[si].UTCI;
# ---------- end c_script_2 ----------
number_slider_4 = Slider(209, range=1..365)
panel_24 = Panel("""UTCI EPW
UTCI SIM
AmbTemp EPW""")
cluster_2 = Cluster_2(doy=number_slider_4)
cluster_3 = Cluster(L=panel_24)  # -> C, R

# ----
# Comparing DDS simulation to weather file total horizontal radiation
weather_2 = Weather(
    Location=path,
    Input_0_Hidden=False,
    Input_0_Name="Location",
    Output_0_Hidden=False,
    Output_0_Name="Location",
    Output_10_Hidden=False,
    Output_10_Name="DiffuseHorizontalRadiation",
    Output_11_Hidden=False,
    Output_11_Name="GlobalHorizontalRadiation",
    Output_12_Hidden=True,
    Output_12_Name="SkyCover",
    Output_13_Hidden=True,
    Output_13_Name="Precipitation",
    Output_14_Hidden=True,
    Output_14_Name="Elev",
    Output_15_Hidden=True,
    Output_15_Name="Azimuth",
    Output_16_Hidden=True,
    Output_16_Name="Vector",
    Output_17_Hidden=True,
    Output_17_Name="Illuminance",
    Output_18_Hidden=True,
    Output_18_Name="DateTime",
    Output_19_Hidden=True,
    Output_19_Name="DryBulbAverages",
    Output_1_Hidden=True,
    Output_1_Name="Latitude",
    Output_20_Hidden=True,
    Output_20_Name="DewPointAverages",
    Output_21_Hidden=True,
    Output_21_Name="DryBulbMinima"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)  # -> Location, DryBulbTemp, RelativeHumidity, DirectNormalRadiation, DiffuseHorizontalRadiation, GlobalHorizontalRadiation
c_script_3 = CSharpScript(x=lrad.Result, si="0", Reference="C:\Eddy3D\EddyLib.dll")  # -> out, TotalRad, dMRT, LMRT; inputs si: Int32
# ---------- c_script_3: C# ----------
    MRT_Simulation_ResultProto res = (MRT_Simulation_ResultProto) x;

    var list = new List<float> ();
    list.AddRange(res.Probes[si].TotalRad);

    TotalRad = list;
    dMRT = res.Probes[si].SolarGain_dMRT;
    LMRT = res.Probes[si].LongWave_MRT;
   // MRT = res.Probes[si].
# ---------- end c_script_3 ----------
number_slider_5 = Slider(143, range=1..365)
entwine_2 = Entwine(
    Branch00=weather_2.GlobalHorizontalRadiation,
    Branch01=weather_2.DiffuseHorizontalRadiation,
    Branch02=weather_2.DirectNormalRadiation,
    Branch03=c_script_3.TotalRad,
    Branch04=c_script_3.dMRT,
    Branch05=c_script_3.LMRT,
    FlattenInputs=True)
panel_25 = Panel("""GHR
DHR
DNI
SIM_TotalRad
SIM_SolarGain_dMRT
SIM_LWMRT""")
cluster_4 = Cluster_2(doy=number_slider_4)
cluster_5 = Cluster(L=panel_25)  # -> C, R
subset = SubList(List=entwine_2, Domain=cluster_4, Wrap=True)  # -> List, Index
xyplot = XYPlot(
    Type=0,
    Width=550,
    Height=450,
    Title="Radiation [W/m2]",
    X_rot=0,
    Y_data=subset.List,
    Colors=cluster_5.C,
    Names=panel_25,
    Show_xgrid=False,
    Show_ygrid=True,
    Legend=0)

addition = Addition(A=weather.DryBulbTemp, B=Slider(0, range=0..20))
utci_3 = UTCI(
    AmbientTemperature=weather.DryBulbTemp,
    MeanRadiantTemperature=addition,
    WindVelocity=weather.WindSpeed,
    RelativeHumidity=weather.RelativeHumidity)

entwine_3 = Entwine(Branch00=utci_3, Branch01=c_script_2, Branch02=weather.DryBulbTemp, FlattenInputs=True)
subset_2 = SubList(List=entwine_3, Domain=cluster_2, Wrap=True)  # -> List, Index
xyplot_2 = XYPlot(
    Type=0,
    Width=550,
    Height=450,
    Title="Radiation [W/m2]",
    X_rot=0,
    Y_data=subset_2.List,
    Colors=cluster_3.C,
    Names=panel_24,
    Show_xgrid=False,
    Show_ygrid=True,
    Legend=0)

bang = ExplodeTree(Data=subset.List)  # -> Branch0, Branch1, Branch2, Branch3, Branch4, Branch5
panel_26 = Panel(bang.Branch4)

# ==== cluster Cluster
L = ClusterInput()
lng = ListLength(List=L)
series = Series(Start=0, Step=1, Count=lng)
gradient = Gradient(
    LowerLimit=0,
    UpperLimit=lng,
    Parameter=series,
    stops=[0: RGB(243, 57, 0), 0.1: RGB(236, 27, 60), 0.2: RGB(210, 0, 118), 0.3: RGB(103, 0, 120), 0.4: RGB(39, 72, 161), 0.5: RGB(1, 192, 229), 0.6: RGB(18, 178, 90), 0.7: RGB(79, 186, 8), 0.8: RGB(220, 237, 32), 0.9: RGB(247, 159, 20), 1: RGB(243, 57, 0)])
concat = Concatenate(FragmentA="Panel ", FragmentB=series)
C = ClusterOutput(gradient)
R = ClusterOutput(concat)

# ==== cluster Cluster_2
doy = ClusterInput()
md = MonthAndDay(DayOfYearIndex=doy)  # -> Month, Day
hoy = HourOfYear(Month=md.Month, Day=md.Day, Hour=1)
multiplication = Multiplication(A="24", B="7")
addition = Addition(A=hoy, B=multiplication)
dom = ConstructDomain(DomainStart=hoy, DomainEnd=addition)
I = ClusterOutput(dom)

# ==== cluster Cluster_3
S = ClusterInput()
series = Series(Start=S, Step=1, Count=11)
panel = Panel("""extreme heat stess
very strong heat stress
strong heat stress
moderage heat stress
slight heat stress
no thermal stress
slight cold stress
moderate cold stress
strong cold stress
very strong cold stress
extreme cold stress""")
F = ClusterInput()
samplefc = SampleCSFalsecolor(Falsecolor=F, Value=series, UnitSystem=4)
col = Colour(samplefc)
col_2 = ClusterOutput(col)
rev = ReverseList(List=panel)
L = ClusterOutput(rev)
